# Grasshopper definition 2D_Parachute_base.gh (Grasshopper 1.0.7)

# ----
# Create mesh method 1 (rectangular)
crv = Curve(<curve referenced from the Rhino model>)
# SETTING UP YOUR INPUT MESH: You may create meshes using Grasshopper or directly in Rhino.
# 
# Refer to the Mesh drop-down menu in Rhino. There are several useful commands in "MEsh Edit Tools" such as weld, unweld and delete faces
# 
# Even if you create a mesh in Grasshopper you may wish to bake it and edit using these tools
boundary = BoundarySurfaces(Edges=crv)
mesh_uv = MeshSurface(Surface=boundary, UCount="20", VCount="20", Overhang=True, Equalize=False)
mesh = Mesh(mesh_uv)

parachute_weight = Panel("1.5")
load_weight = Panel("5")

# ----
# Input
# Geometry
pts_anchor = Point([<point referenced from the Rhino model> x4])
pt_load = Point(<point referenced from the Rhino model>)
mesh_2 = Mesh(<mesh referenced from the Rhino model>)

topology = Topology(mesh=mesh_2)  # -> nodes_2, faces, edges_2, fans_2

# ---- group: Set weight of mesh vertex
lng = ListLength(List=topology.nodes_2)
division = Division(A=parachute_weight, B=lng)
repeat = RepeatData(Data=division, Length=lng)

# ---- group: Get average length of mesh edge
medges = MeshEdges(Mesh=mesh_2)  # -> NakedEdges, InteriorEdges, NonManifoldEdges
len = Length(Curve=[medges.NakedEdges, medges.InteriorEdges, medges.NonManifoldEdges])
avr = Average(Input=len)

# ---- group: Get Average length of anchor lines
ln = Line(StartPoint=pts_anchor, EndPoint=pt_load)
len_2 = Length(Curve=ln)
avr_2 = Average(Input=len_2)

# ---- group: Add position and weight of load to end of list
merge = Merge(Data1=flatten(repeat), Data2=flatten(load_weight))
merge_2 = Merge(Data1=flatten(topology.nodes_2), Data2=flatten(pt_load))

# ---- group: Avoid duplicates
end = EndPoints(Curve=medges.NakedEdges)  # -> Start, End
sunion = SetUnion(SetA=end.Start, SetB=end.End)

# ----
zero = Zero(positions=merge_2)

# ----
# Get Indices of Points on naked edges
panel = Panel(" 0.1")
get_indices = GetIndices(nodes=topology.nodes_2, testpoints=sunion, dist=panel)
vertex_indices = Panel(get_indices)

# ----
# Get Indices of Anchor Points
panel_2 = Panel(" 0.1")
get_indices_2 = GetIndices(nodes=topology.nodes_2, testpoints=pts_anchor, dist=panel_2)
anchor_pts_mesh_vertex_indices = Panel(get_indices_2)

# ----
# Initial State
positions = Point(merge_2)
zero_vector = Vector(zero)
masses = Number(merge)
pack = Pack_2(positions=positions, velocities=zero_vector, masses=masses)
initial = Text(pack)

# ----
# Global forces
d = Slider(0.033, range=0..0.2)
g = Slider(9.81, range=-10..10)

# ----
# Spring
# related
number_slider = Slider(0.517, range=0..0.7)
anchor_line_length = Number(expr("x * 0.75", avr_2))
mesh_edge_lengths = Number(avr)
anchor_indices = Number(anchor_pts_mesh_vertex_indices)

# ----
# Pressure
# related
indices_of_naked_edgeendpoints = Integer(vertex_indices)
s = Slider(4.5, range=0..9)

# ----
# Mesh topology
edges = Integer(topology.edges_2)
faces = MeshFace(topology.faces)
fans = Integer(topology.fans_2)

# ---- group: Spray Points
pt = Point(pts_anchor)

# ---- group: Method 1: Colour your mesh using spray points
# Set spray points on input mesh
# Number of points  = num of colour inputs
swatch = ColourSwatch(SwatchColor=RGB(249, 224, 255))
swatch_2 = ColourSwatch(SwatchColor=RGB(224, 139, 207))
swatch_3 = ColourSwatch(SwatchColor=RGB(136, 165, 252))
mesh_3 = Mesh(mesh_2)
merge_3 = Merge(
    Data1=swatch,
    Data2=ColourSwatch(SwatchColor=RGB(36, 148, 255)),
    Data3=ColourSwatch(SwatchColor=RGB(216, 91, 73)),
    Data4=ColourSwatch(SwatchColor=RGB(235, 87, 205)))
mspray = MeshSpray(Mesh=mesh_3, Points=pt, Colours=merge_3, SprayMode=11)
demesh = DeconstructMesh(Mesh=mspray)  # -> Vertices, Faces, Colours, Normals

# ---- group: Method 2: Use Materials specified in Rhino
# Ultra Blue Transparent Plastic
panel_3 = Panel("SUTD")

# ----
# Create mesh method 2 (freeform)
number_slider_2 = Slider(8.244, range=5..10)
crv_2 = Curve(<curve referenced from the Rhino model>)
custom_mesh_settings = SettingsCustom(
    StitchSeams=True,
    SimplePlanes=False,
    Refine=True,
    MinCount=16,
    MaxCount=400,
    AspectRatio=20,
    MaxDistance=0,
    MaxAngle=20,
    MinEdge=number_slider_2,
    MaxEdge=Slider(12.381, range=1..20))
boundary_2 = BoundarySurfaces(Edges=crv_2)
mesh_4 = MeshBrep(Brep=boundary_2, Settings=custom_mesh_settings)

tri = Triangulate(Mesh=mesh_4)  # -> Mesh, Count

mesh_5 = Mesh(tri.Mesh)

# ----
# CONTROL
reset = Button()
timer = Timer(TimerInterval=50, Target=control)  # disabled
update = Button()
control = Control(reset=reset, update=update, initial=initial)  # -> positions, velocities, masses

# ----
# State
velocities = Vector(control.velocities)
positions_2 = Point(control.positions)
masses_2 = Number(control.masses)

# ----
# Analysis
drag = Drag(factor=d, velocity=velocities)
gravity = Gravity(acceleration=g, mass=masses_2)
springs_parachute = SpringsParachute(positions=positions_2, edges=edges, rest_length=mesh_edge_lengths, stiffness=number_slider)
springs_anchors = SpringsAnchors(
    positions=positions_2,
    anchor_pt_indices=anchor_indices,
    rest_length=anchor_line_length,
    stiffness=Slider(1.5, range=0.3..2))
pressure = Pressure(positions=positions_2, faces=faces, fans=fans, strength=s, naked_edge_point_index=indices_of_naked_edgeendpoints)
addition = Addition(A=springs_parachute, B=springs_anchors)
addition_2 = Addition(Drag=drag, Gravity=gravity, Springs=addition, Pressure=pressure)

# ----
# Integrate and Constraint
integrate = Integrate(positions=positions_2, velocities=velocities, masses=masses_2, forces=addition_2)  # -> positions_4, velocities_4, masses_4
enable = BooleanToggle(False)
constraint = Constraint(positions=integrate.positions_4, velocities=integrate.velocities_4, masses=integrate.masses_4, enable=enable)  # -> positions_5, velocities_5, masses_5

# ----
# Visualisation
# Visualize Parachute mesh
# True to use spray method
# False to use Rhino material
# Visualize Forces, velocities,
# anchors & load
toggle = BooleanToggle(True)
positions_3 = Point(control.positions)
faces_2 = MeshFace(faces)
forces = Vector(addition_2)
anchor_indices_2 = Number(anchor_indices)
velocities_2 = Vector(control.velocities)
filter = StreamFilter(Gate=toggle, Stream1=demesh.Colours)
anchors_load = AnchorsLoad(positions=positions_3, anchor_indices=anchor_indices_2)
forces_velocities = ForcesVelocities(positions=positions_3, forces=forces, velocities=velocities_2)
construct_mesh = ConstructMesh(Vertices=positions_3, Faces=faces_2, Colours=flatten(filter))
medges_2 = MeshEdges(Mesh=construct_mesh)  # -> NakedEdges, InteriorEdges, NonManifoldEdges
preview = CustomPreview(Geometry=construct_mesh, Material=panel_3)

persist = Persist(positions=constraint.positions_5, velocities=constraint.velocities_5, masses=constraint.masses_5)

# ==== cluster Integrate
positions = ClusterInput()
velocities = ClusterInput()
masses = ClusterInput()
forces = ClusterInput()
forces_2 = Vector(forces)

# ---- group: State
velocities_2 = Vector(velocities)
positions_2 = Point(positions)
masses_2 = Number(masses)

# ---- group: Time Step
dt = Slider(0.05, range=0.001..0.1)

# ---- group: Acceleration
a_b = GhPythonScript(A=forces_2, B=masses_2)  # -> C
# ---------- a_b: Python ----------
C = 0 * A if B == 0 else A / B
# ---------- end a_b ----------

# ---- group: Acceleration * dt
multiplication = Multiplication(A=a_b, B=dt)

# ---- group: Velocity += Acceleration * dt
addition = Addition(A=multiplication, B=velocities_2)

# ---- group: Velocity * dt
multiplication_2 = Multiplication(A=addition, B=dt)

# ---- group: Position += Velocity * dt
addition_2 = Addition(A=multiplication_2, B=positions_2)

# ---- group: States
positions_3 = Point(addition_2)
velocities_3 = Vector(addition)
masses_3 = Number(masses_2)

# ----
positions_4 = ClusterOutput(positions_3)
velocities_4 = ClusterOutput(velocities_3)
masses_4 = ClusterOutput(masses_3)

# ==== cluster Constraint
positions = ClusterInput()
velocities = ClusterInput()
masses = ClusterInput()
enable = ClusterInput()

# ---- group: States
velocities_2 = Vector(velocities)
positions_2 = Point(positions)
masses_2 = Number(masses)

# ----
enable_2 = Boolean(enable)
deconstruct_vector = DeconstructVector(Vector=velocities_2)  # -> XComponent, YComponent, ZComponent
deconstruct = Deconstruct(Point=positions_2)  # -> XComponent, YComponent, ZComponent
limit = Number("25")
clamp = GhPythonScript(Value=deconstruct.XComponent, Limit=limit)  # -> Clamped, Reverse
# ---------- clamp: Python ----------
Clamped = -Limit if( Value < -Limit ) else Limit if( Value > Limit ) else Value
Reverse = -1 if( ( Value < -Limit ) or ( Value > Limit ) ) else 1
# ---------- end clamp ----------
clamp_2 = GhPythonScript(Value=deconstruct.YComponent, Limit=limit)  # -> Clamped, Reverse
# ---------- clamp_2: Python ----------
Clamped = -Limit if( Value < -Limit ) else Limit if( Value > Limit ) else Value
Reverse = -1 if( Value < -Limit or Value > Limit ) else 1
# ---------- end clamp_2 ----------
clamp_3 = GhPythonScript(Value=deconstruct.ZComponent, Limit=limit)  # -> Clamped, Reverse; same code as clamp_2
multiplication = Multiplication(A=deconstruct_vector.YComponent, B=clamp_2.Reverse)
multiplication_2 = Multiplication(A=deconstruct_vector.ZComponent, B=clamp_3.Reverse)
multiplication_3 = Multiplication(A=deconstruct_vector.XComponent, B=clamp.Reverse)
vector_xyz = VectorXYZ(XComponent=multiplication_3, YComponent=multiplication, ZComponent=multiplication_2)  # -> Vector, Length
construct_point = ConstructPoint(XCoordinate=clamp.Clamped, YCoordinate=clamp_2.Clamped, ZCoordinate=clamp_3.Clamped)

# ---- group: States
velocities_3 = Vector(vector_xyz.Vector)
positions_3 = Point(construct_point)
masses_3 = Number(masses_2)

# ----
stream_gate = StreamGate(Stream=limit, Gate=enable_2)  # -> Target0, Target1

# ---- group: Enable / Disable Constraints Bypass
stream_filter = StreamFilter(Gate=enable_2, Stream0=positions_2, Stream1=positions_3)
stream_filter_2 = StreamFilter(Gate=enable_2, Stream0=velocities_2, Stream1=velocities_3)
stream_filter_3 = StreamFilter(Gate=enable_2, Stream0=masses_2, Stream1=masses_3)

# ----
negative = Negative(Value=stream_gate.Target1)
construct_domain = ConstructDomain(DomainStart=negative, DomainEnd=stream_gate.Target1)

# ---- group: States
velocities_4 = Vector(stream_filter_2)
positions_4 = Point(stream_filter)
masses_4 = Number(stream_filter_3)

# ----
velocities_5 = ClusterOutput(velocities_4)
masses_5 = ClusterOutput(masses_4)
positions_5 = ClusterOutput(positions_4)
domain_box = DomainBox(Base=PlaneXY(0, 0, 0), X=construct_domain, Y=construct_domain, Z=construct_domain)
custom_preview = CustomPreview(Geometry=domain_box, Material=ColourSwatch(SwatchColor=RGBA(186, 187, 255, 0)))

# ==== cluster Control
reset = ClusterInput()
update = ClusterInput()
initial = ClusterInput()
reset_2 = Boolean(reset)
initial_2 = Text(initial)
update_2 = Boolean(update)
gate_or = GateOr(A=reset_2, B=update_2)
load = GhPythonScript(push=gate_or)  # -> data
# ---------- load: Python ----------
import Rhino
data = Rhino.RhinoDoc.ActiveDoc.Notes
# ---------- end load ----------
stream_filter = StreamFilter(Gate=reset_2, Stream0=load, Stream1=initial_2)
unpack = Unpack(text=stream_filter)  # -> positions_2, velocities_2, masses_2
positions = ClusterOutput(unpack.positions_2)
velocities = ClusterOutput(unpack.velocities_2)
masses = ClusterOutput(unpack.masses_2)

# ==== cluster Persist
positions = ClusterInput()
velocities = ClusterInput()
masses = ClusterInput()
pack = Pack(positions=positions, velocities=velocities, masses=masses)
save = GhPythonScript(data=pack)  # -> data
# ---------- save: Python ----------
import Rhino
Rhino.RhinoDoc.ActiveDoc.Notes = data
# ---------- end save ----------

# ==== cluster Topology
mesh = ClusterInput()
deconstruct_mesh = DeconstructMesh(Mesh=mesh)  # -> Vertices, Faces, Colours, Normals
edges = Edges(faces=deconstruct_mesh.Faces, vertices=deconstruct_mesh.Vertices)  # -> simplify(edges)
fans = Fans(vertices=deconstruct_mesh.Vertices, faces=deconstruct_mesh.Faces)  # -> simplify(fans_2)
nodes = Point(deconstruct_mesh.Vertices)
edges_2 = ClusterOutput(edges)
nodes_2 = ClusterOutput(nodes)
faces = ClusterOutput(deconstruct_mesh.Faces)
fans_2 = ClusterOutput(fans)

# ==== cluster Pack_2
positions = ClusterInput()
velocities = ClusterInput()
masses = ClusterInput()

# ---- group: States
positions_2 = Point(positions)
velocities_2 = Vector(velocities)
masses_2 = Number(masses)

# ----
deconstruct_vector = DeconstructVector(Vector=velocities_2)  # -> XComponent, YComponent, ZComponent
deconstruct = Deconstruct(Point=positions_2)  # -> XComponent, YComponent, ZComponent
entwine = Entwine(
    Branch00=deconstruct.XComponent,
    Branch01=deconstruct.YComponent,
    Branch02=deconstruct.ZComponent,
    Branch03=deconstruct_vector.XComponent,
    Branch04=deconstruct_vector.YComponent,
    Branch05=deconstruct_vector.ZComponent,
    Branch06=masses_2,
    FlattenInputs=True)
flip_matrix = FlipMatrix(Data=entwine)
text_join = TextJoin(Text=flip_matrix, Join=",")  # -> flatten(Result)
text_join_2 = TextJoin(Text=text_join, Join=";")
result = ClusterOutput(text_join_2)

# ==== cluster Zero
positions = ClusterInput()
positions_2 = Point(positions)
_0 = Integer(0)
multiplication = Multiplication(A=positions_2, B=_0)
velocities = Vector(multiplication)
velocities_2 = ClusterOutput(velocities)

# ==== cluster GetIndices
testpoints = ClusterInput()
dist = ClusterInput()
nodes = ClusterInput()
testpoints_2 = Point(testpoints)
dist_2 = Number(dist)
nodes_2 = Point(nodes)
dist_3 = Distance(PointA=nodes_2, PointB=graft(testpoints_2))
smaller = SmallerThan(FirstNumber=dist_3, SecondNumber=dist_2)  # -> SmallerThan, OrEqualTo
dispatch = Dispatch(List=nodes_2, DispatchPattern=smaller.SmallerThan)  # -> flatten(ListA), ListB
index = ItemIndex(List=nodes_2, Item=dispatch.ListA)
i = ClusterOutput(index)

# ==== cluster SpringsParachute
positions = ClusterInput()
edges = ClusterInput()
rest_length = ClusterInput()
stiffness = ClusterInput()
rest_length_2 = Number(rest_length)
edges_2 = Integer(edges)
# Calulate forces acting on nodes from mesh edge springs
positions_2 = Point(positions)
stiffness_2 = Number(stiffness)

# ---- group: Remove last node (load)
cull_i = CullIndex(List=positions_2, Indices="-1", Wrap=True)

# ----
list_item = ListItem(List=cull_i, Index=edges_2, Wrap=True)
vector_2pt = Vector2Pt(PointA=list_item, PointB=graft(cull_i), Unitize=False)  # -> Vector, Length
subtraction = Subtraction(A=rest_length_2, B=vector_2pt.Length)
unit_vector = UnitVector(Vector=vector_2pt.Vector)
multiplication = Multiplication(A=subtraction, B=stiffness_2)
multiplication_2 = Multiplication(A=unit_vector, B=multiplication)
mass_addition = MassAddition(Input=multiplication_2)  # -> flatten(Result), PartialResults

# ---- group: Add zero vector at end of list (point load)
zero_vector = Vector(Vector(0, 0, 0))
merge = Merge(Data1=flatten(mass_addition.Result), Data2=zero_vector)

# ----
force = Vector(merge)
force_2 = ClusterOutput(force)

# ==== cluster SpringsAnchors
anchor_pt_indices = ClusterInput()
rest_length = ClusterInput()
positions = ClusterInput()
stiffness = ClusterInput()
positions_2 = Point(positions)
anchor_pt_indices_2 = Integer(anchor_pt_indices)
rest_length_2 = Number(rest_length)
stiffness_2 = Number(stiffness)

# ---- group: Load position (last item)
item = ListItem(List=positions_2, Index=" -1", Wrap=True)

# ---- group: Anchor pt positions
item_2 = ListItem(List=positions_2, Index=anchor_pt_indices_2, Wrap=True)

# ----
# Calulate forces acting on nodes from anchor line springs
vector_2pt = Vector2Pt(PointA=item, PointB=graft(item_2), Unitize=False)  # -> Vector, Length

unit_vector = UnitVector(Vector=vector_2pt.Vector)
subtraction = Subtraction(A=rest_length_2, B=vector_2pt.Length)
multiplication = Multiplication(A=subtraction, B=stiffness_2)
multiplication_2 = Multiplication(A=unit_vector, B=multiplication)  # -> flatten(Result)

cull_i = CullIndex(List=positions_2, Indices=" -1", Wrap=True)

# ---- group: Foce on Load point
avr = Average(Input=flatten(multiplication_2))
rev = Reverse(Vector=avr)

# ----
zero_vector = Vector(Vector(0, 0, 0))
lng = ListLength(List=cull_i)
rev_2 = Reverse(Vector=multiplication_2)
repeat = RepeatData(Data=zero_vector, Length=lng)
replace = ReplaceItems(List=repeat, Item=multiplication_2, Indices=anchor_pt_indices_2, Wrap=False)
merge = Merge(Data1=flatten(replace), Data2=rev)
node_forces = Vector(merge)
node_forces_2 = ClusterOutput(node_forces)

# ==== cluster Pressure
positions = ClusterInput()
faces = ClusterInput()
fans = ClusterInput()
strength = ClusterInput()
naked_edge_point_index = ClusterInput()
positions_2 = Point(positions)
faces_2 = MeshFace(faces)
fans_2 = Integer(fans)
strength_2 = Number(strength)
naked_edge_point_index_2 = Integer(naked_edge_point_index)
cull_i = CullIndex(List=positions_2, Indices=" -1", Wrap=True)
normals = Normals(vertices=cull_i, faces=faces_2, fans=fans_2)
multiplication = Multiplication(A=normals, B=strength_2)
zero_vector = Vector(Vector(0, 0, 0))

# ---- group: Set pressure force on all nodes along naked edge and load point to zero
replace = ReplaceItems(List=multiplication, Item=zero_vector, Indices=naked_edge_point_index_2, Wrap=False)
merge = Merge(Data1=flatten(replace), Data2=flatten(zero_vector))

# ----
pressure_force = Vector(merge)
pressure_force_2 = ClusterOutput(pressure_force)

# ==== cluster Gravity
acceleration = ClusterInput()
mass = ClusterInput()
acceleration_2 = Number(acceleration)
mass_2 = Number(mass)
unit_z = UnitZ(Factor=acceleration_2)
negative = Negative(Value=unit_z)
multiplication = Multiplication(A=negative, B=mass_2)
force = Vector(multiplication)
force_2 = ClusterOutput(force)

# ==== cluster Drag
velocity = ClusterInput()
factor = ClusterInput()
velocity_2 = Vector(velocity)
factor_2 = Number(factor)
multiplication = Multiplication(A=factor_2, B=velocity_2)
negative = Negative(Value=multiplication)
force = Vector(negative)
force_2 = ClusterOutput(force)

# ==== cluster AnchorsLoad
positions = ClusterInput()
anchor_indices = ClusterInput()
positions_2 = Point(positions)
anchor_indices_2 = Number(anchor_indices)

# ---- group: Anchor lines and parachute load Visualisation
rev = ReverseList(List=positions_2)
item = ListItem(List=positions_2, Index=anchor_indices_2, Wrap=True)
item_2 = ListItem(List=rev, Index=0, Wrap=True)
ln = Line(StartPoint=item_2, EndPoint=item)
msphereex = MeshSphereEx(Base=item_2, Radius="4", Count="1")

# ==== cluster ForcesVelocities
positions = ClusterInput()
forces = ClusterInput()
velocities = ClusterInput()
positions_2 = Vector(positions)
forces_2 = Vector(forces)
velocities_2 = Vector(velocities)

# ---- group: Force Visualization
scale = Slider(0.5, range=0..20)
multiplication = Multiplication(A=forces_2, B=scale)  # disabled
vector_display_ex = VectorDisplayEx(Point=positions_2, Vector=multiplication, Colour=ColourSwatch(SwatchColor=RGB(168, 222, 53)), Width=5)

# ---- group: Velocity Visualization
scale_2 = Slider(0.5, range=0..100)
multiplication_2 = Multiplication(A=velocities_2, B=scale_2)  # disabled
vector_display_ex_2 = VectorDisplayEx(Point=positions_2, Vector=multiplication_2, Colour=ColourSwatch(SwatchColor=RGB(255, 71, 71)), Width=5)

# ==== cluster Unpack
text = ClusterInput()
text_split = TextSplit(Text=text, Separators=";")
text_split_2 = TextSplit(Text=text_split, Separators=",")
list_item = ListItem(List=text_split_2, Index=0, Wrap=True)  # -> Item, Item1, Item2, Item3, Item4, Item5, Item6
vector_xyz = VectorXYZ(XComponent=list_item.Item3, YComponent=list_item.Item4, ZComponent=list_item.Item5)  # -> Vector, Length
construct_point = ConstructPoint(XCoordinate=list_item.Item, YCoordinate=list_item.Item1, ZCoordinate=list_item.Item2)

# ---- group: States
velocities = Vector(flatten(vector_xyz.Vector))
positions = Point(flatten(construct_point))
masses = Number(flatten(list_item.Item6))

# ----
masses_2 = ClusterOutput(masses)
positions_2 = ClusterOutput(positions)
velocities_2 = ClusterOutput(velocities)

# ==== cluster Pack
positions = ClusterInput()
velocities = ClusterInput()
masses = ClusterInput()

# ---- group: State
positions_2 = Point(positions)
velocities_2 = Vector(velocities)
masses_2 = Number(masses)

# ----
deconstruct_vector = DeconstructVector(Vector=velocities_2)  # -> XComponent, YComponent, ZComponent
deconstruct = Deconstruct(Point=positions_2)  # -> XComponent, YComponent, ZComponent
entwine = Entwine(
    Branch00=deconstruct.XComponent,
    Branch01=deconstruct.YComponent,
    Branch02=deconstruct.ZComponent,
    Branch03=deconstruct_vector.XComponent,
    Branch04=deconstruct_vector.YComponent,
    Branch05=deconstruct_vector.ZComponent,
    Branch06=masses_2,
    FlattenInputs=True)
flip_matrix = FlipMatrix(Data=entwine)
text_join = TextJoin(Text=flip_matrix, Join=",")  # -> flatten(Result)
text_join_2 = TextJoin(Text=text_join, Join=";")
result = ClusterOutput(text_join_2)

# ==== cluster Edges
vertices = ClusterInput()
faces = ClusterInput()
enum = Enum(list=vertices)
faces_2 = MeshFace(faces)
pointinedge = GhPythonScript(T=graft(faces_2), I=enum)  # -> U, V; inputs I: Int32
# ---------- pointinedge: Python ----------
if( T.IsQuad ):
  if( I == T.A ):
    U = T.B
    V = T.D
  else:
    if( I == T.B ):
      U = T.C
      V = T.A
    else:
      if( I == T.C ):
        U = T.D
        V = T.B
      else:
        if( I == T.D ):
          U = T.A
          V = T.C
        else:
          U = -1
          V = -1
else:
  if( I == T.A ):
    U = T.B
    V = T.C
  else:
    if( I == T.B ):
      U = T.C
      V = T.A
    else:
      if( I == T.C ):
        U = T.A
        V = T.B
      else:
        U = -1
        V = -1
# ---------- end pointinedge ----------

# ---- group: Reshape Indices
flip_matrix = FlipMatrix(Data=pointinedge.U)
flip_matrix_2 = FlipMatrix(Data=pointinedge.V)
merge = Merge(Data1=flip_matrix, Data2=flip_matrix_2)

# ---- group: Remove Duplicates
create_set = CreateSet(List=merge)  # -> Set, Map

# ----
integer = Integer(-1)

# ---- group: Remove Invalid
set_difference = SetDifference(SetA=create_set.Set, SetB=graft(integer))

# ----
edges = ClusterOutput(set_difference)

# ==== cluster Fans
vertices = ClusterInput()
faces = ClusterInput()
vertices_2 = Point(vertices)
faces_2 = MeshFace(faces)
deconstruct_face = DeconstructFace(Face=graft(faces_2))  # -> CornerA, CornerB, CornerC, CornerD
enum = Enum(list=vertices_2)
equality = Equality(FirstNumber=deconstruct_face.CornerB, SecondNumber=enum)  # -> Equality, Inequality
equality_2 = Equality(FirstNumber=deconstruct_face.CornerA, SecondNumber=enum)  # -> Equality, Inequality
equality_3 = Equality(FirstNumber=deconstruct_face.CornerC, SecondNumber=enum)  # -> Equality, Inequality
equality_4 = Equality(FirstNumber=deconstruct_face.CornerD, SecondNumber=enum)  # -> Equality, Inequality
gate_or = GateOr(A=equality_2.Equality, B=equality.Equality, C=equality_3.Equality, D=equality_4.Equality)
flip_matrix = FlipMatrix(Data=gate_or)
enum_2 = Enum(list=faces_2)
dispatch = Dispatch(List=enum_2, DispatchPattern=flip_matrix)  # -> ListA, ListB
fans = Integer(dispatch.ListA)
fans_2 = ClusterOutput(fans)

# ==== cluster Normals
vertices = ClusterInput()
faces = ClusterInput()
fans = ClusterInput()
vertices_2 = Point(vertices)
fans_2 = Integer(fans)
faces_2 = MeshFace(faces)
deconstruct_face = DeconstructFace(Face=faces_2)  # -> CornerA, CornerB, CornerC, CornerD
list_item = ListItem(List=vertices_2, Index=deconstruct_face.CornerC, Wrap=True)
list_item_2 = ListItem(List=vertices_2, Index=deconstruct_face.CornerB, Wrap=True)
list_item_3 = ListItem(List=vertices_2, Index=deconstruct_face.CornerA, Wrap=True)
subtraction = Subtraction(A=list_item_2, B=list_item_3)
subtraction_2 = Subtraction(A=list_item, B=list_item_2)
cross_product = CrossProduct(VectorA=subtraction, VectorB=subtraction_2, Unitize=False)  # -> Vector, Length
list_item_4 = ListItem(List=cross_product.Vector, Index=fans_2, Wrap=True)
mass_addition = MassAddition(Input=list_item_4)  # -> flatten(Result), PartialResults
unit_vector = UnitVector(Vector=mass_addition.Result)
vector = ClusterOutput(unit_vector)

# ==== cluster Enum
list = ClusterInput()
list_length = ListLength(List=list)
series = Series(Start=0, Step=1, Count=list_length)
series_2 = ClusterOutput(series)
