# Grasshopper definition BRIDGE.gh (Grasshopper 1.0.7)

number_slider = Slider(2, range=1..64)
cycles = Slider(0.286, range=0..10)
radius = Slider(2.659, range=0..10)
phase = Slider(1.556, range=0..10)
series = Series(Start=Slider(1, range=1..100), Step=expr("1/(x-1)", number_slider), Count=number_slider)
crv = Curve(<curve referenced from the Rhino model>)
crv_2 = Curve(<curve referenced from the Rhino model>)
crv_3 = Curve(<curve referenced from the Rhino model>)
frame = CurveFrame(Curve=crv_2, Parameter=series)
panel = Panel(series)
panel_2 = Panel(frame)
deplane = DeconstructPlane(Plane=frame)  # -> Origin, XAxis, YAxis, ZAxis
binormal = Vector(deplane.ZAxis)
tangent = Vector(deplane.XAxis)
normal = Vector(deplane.YAxis)
panel_3 = Panel(deplane.Origin)
panel_4 = Panel(deplane.XAxis)
python = GhPythonScript(origin=deplane.Origin, normal=normal, binormal=binormal, r=radius, cycles=cycles, series=series, phase=phase)  # -> out, a
# ---------- python: Python ----------
__author__ = "user"
__version__ = "2020.10.01"

import rhinoscriptsyntax as rs
from math import sin, cos

out = origin + (
    normal * r * cos(cycles + series * phase) + 
    binormal * r * sin(cycles + series * phase)
)

# out = out[0]
print(type(out))
# ---------- end python ----------
multiplication = Multiplication(A=series, B=phase)
expression = Expression(Expression="origin + normal * r * cos(cycles + series * phase) + binormal * r * sin(cycles + series * phase)")
addition = Addition(A=multiplication, B=cycles)
panel_5 = Panel(python.out)
series_2 = Series(Start=0, Step=1, Count=10)
sin = Sine(Value=addition)
cos = Cosine(Value=addition)
multiplication_2 = Multiplication(A=cos, B=radius)
multiplication_3 = Multiplication(A=sin, B=radius)
multiplication_4 = Multiplication(A=normal, B=multiplication_2)
multiplication_5 = Multiplication(A=binormal, B=multiplication_3)
addition_2 = Addition(A=multiplication_4, B=multiplication_5)
bar_graph = BarGraph(BarColor=RGB(255, 0, 90))
addition_3 = Addition(A=deplane.Origin, B=addition_2)
python_2 = GhPythonScript(x=addition_3)  # -> out, a
# ---------- python_2: Python ----------
__author__ = "user"
__version__ = "2020.10.01"

import rhinoscriptsyntax as rs

print(type(x))
# ---------- end python_2 ----------
panel_6 = Panel(addition_3)
