# Grasshopper definition CURVES.gh (Grasshopper 1.0.7)

crv = Curve(<curve referenced from the Rhino model>)
number_slider = Slider(7, range=1..10)
len = Length(Curve=crv)
divide = DivideCurve(Curve=crv, Count=number_slider, Kinks=False)  # -> Points, Tangents, Parameters
divdist = DivideDistance(Curve=crv, Distance=number_slider)  # -> Points, Tangents, Parameters
points = PointList(Points=divide.Points)
crvdom = CurveDomain(Curve=crv)  # -> Curve, Domain
shift = ShiftList(List=divide.Points, Shift=1, Wrap=True)
item = ListItem(List=shift, Index=Slider(0, range=0..10), Wrap=True)  # -> Item1, Item, Item1_2
divlength = DivideLength(Curve=crv, Length=number_slider)  # -> Points, Tangents, Parameters; disabled
dedomain = DeconstructDomain(Domain=crvdom.Domain)  # -> Start, End
curvepoint = PointOnCurve(crv, parameter=0.466)
index = ItemIndex(List=shift, Item=item.Item)
panel = Panel(crvdom.Domain)
panel_2 = Panel(dedomain.End)
subtraction = Subtraction(A=dedomain.End, B=dedomain.Start)
dist = Distance(PointA=item.Item1, PointB=item.Item)
cir = Circle(Plane=item.Item1, Radius=1)
multiplication = Multiplication(A=subtraction, B=Slider(0.531, range=0..1))
panel_3 = Panel(dedomain.Start)
panel_4 = Panel(multiplication)
number_slider_2 = Slider(0.653429, range=0..1)
panel_5 = Panel(dist)
divide_2 = DivideCurve(Count=10, Kinks=False)  # -> Points, Tangents, Parameters
series = Series(Start=0, Step=1, Count="10")
expression = Expression(t=series, count="10", Expression="t/(count-1)")
eval = EvaluateCurve(Curve=reparameterize(crv), Parameter=expression)  # -> Point, Tangent, Angle; disabled
