# Grasshopper definition lesson2.gh (Grasshopper 1.0.7)

number_slider = Slider(100, range=1..100)
series = Series(Start=0, Step=1, Count=number_slider)
txt = Text()
pt = ConstructPoint(XCoordinate=0, YCoordinate=0, ZCoordinate=0)
expression = Expression(x=series, y=number_slider, Expression="x/y")
pdecon = Deconstruct()  # -> XComponent, YComponent, ZComponent
panel = Panel(series)
vec = VectorXYZ(XComponent=0, YComponent=0, ZComponent=0)  # -> Vector, Length
pt_2 = Point(Point(7.25094646, 6.783955951, 0))
pt_3 = Point(Point(7.25094646, 6.783955951, 0))
expression_2 = Expression(Expression="Format(\"{0}, {1}\", x, y)")
addition = Addition(A=pt_2, B=pt_3)
dist = Distance()
panel_2 = Panel(expression)
vec2pt = Vector2Pt(PointA=pt_2, PointB=addition, Unitize=False)  # -> Vector, Length
multiplication = Multiplication(A=pt_2, B=pt_3)
pt_4 = ConstructPoint(XCoordinate=0, YCoordinate=0, ZCoordinate=0)
unit = UnitVector()
vdis = VectorDisplay(Anchor=pt_2, Vector=vec2pt.Vector)
vdis_2 = VectorDisplay(Anchor=multiplication, Vector=vec2pt.Vector)
pline = PolyLine(Closed=False)
vec_2 = Vector()
