# Grasshopper definition assignment-2-fanout.gh (Grasshopper 1.0.7)

# ---- group: Width
nx = Slider(96, range=2..100)

# ----
series = Series(Start=0, Step=1, Count=nx)
series_2 = Series(Start=0, Step=1, Count=nx)
thickness = Slider(2.5, range=0..5)
unit_z = UnitZ(Factor=thickness)
construct_point = ConstructPoint(XCoordinate=series_2, YCoordinate=graft(series), ZCoordinate=0)
deconstruct = Deconstruct(Point=construct_point)  # -> XComponent, YComponent, ZComponent
ghpython_script = GhPythonScript(
    x=deconstruct.XComponent,
    y=deconstruct.YComponent,
    count=nx,
    multiplier=Slider(7.03, range=0..10),
    num_points=Slider(12, range=1..50),
    seed=Slider(92, range=1..100),
    min_weight=Slider(1.313546, range=0..10),
    dist_multiplier=Slider(0.96341, range=0..10))  # -> out, z
# ---------- ghpython_script: Python ----------
from math import *
import random

random.seed(22)
num_points = int(num_points)
# num_points = 10

r_points = [
    (random.random() * count, random.random() * count)
    for k in range(num_points)
]

weights = [
    min_weight + multiplier * random.random() 
    for k in range(num_points)
]

min_distance = float('inf')
closest_point = r_points[0]
closest_index = 0
distances = []

for k in range(len(r_points)):
    r_point = r_points[k]
    r_x, r_y = r_point
    
    distance = ((x - r_x) ** 2 + (y - r_y) ** 2) ** 0.5
    distances.append(distance)
    
    if distance < min_distance:
        min_distance = distance
        closest_point = r_point
        closest_index = k
    
z = ((x-closest_point[0]) ** 2 + (y - closest_point[1]) ** 2)
z = z ** 0.5

avg_distance = sum(distances) / len(distances)
weight = weights[closest_index]
z = (z * weight) % (dist_multiplier * avg_distance / min_distance)
# ---------- end ghpython_script ----------
bounds = Bounds(Numbers=flatten(ghpython_script.z))
deconstruct_domain = DeconstructDomain(Domain=bounds)  # -> Start, End
construct_point_2 = ConstructPoint(XCoordinate=deconstruct.XComponent, YCoordinate=deconstruct.YComponent, ZCoordinate=ghpython_script.z)
subtraction = Subtraction(A=deconstruct_domain.End, B=deconstruct_domain.Start)

# ---- group: Depth
panel = Panel(subtraction)

# ----
surface_from_points = SurfaceFromPoints(Points=flatten(construct_point_2), UCount=nx, Interpolate=Toggle(False))
extrude = Extrude(Base=surface_from_points, Direction=unit_z)
mesh_brep = MeshBrep(
    Brep=extrude,
    Settings={GridMaxCount=0, GridMinCount=16, JaggedSeams=False, MaxEdgeLength=0, MinEdgeLength=0.0001, MinTolerance=0, Refine=True, RefineAngle=0, RelativeTolerance=0.65, SimplePlanes=True, Tolerance=0})
panel_2 = Panel(construct_point)
custom_preview = CustomPreview(
    Geometry=extrude,
    Material={diffuse=RGB(249, 49, 63), emission=RGB(0, 0, 0), shine=0, specular=RGB(0, 0, 0), transparency=0})
