# Grasshopper definition assignment_2-outside.gh (Grasshopper 1.0.7)

number_slider = Slider(100, range=1..100)
series = Series(Start=0, Step=1, Count=number_slider)
series_2 = Series(Start=0, Step=1, Count=Slider(100, range=1..100))
python = GhPythonScript(x=series, y=series_2)  # -> z, a; unedited script template
pt = ConstructPoint(XCoordinate=flatten(series), YCoordinate=series_2, ZCoordinate=python.z)
srfgrid = SurfaceFromPoints(Points=flatten(pt), UCount=number_slider, Interpolate=Toggle(False))
