# Grasshopper definition assignment_2.gh (Grasshopper 1.0.7)

# ---- group: Width
nx = Slider(100, range=2..100)

# ----
series = Series(Start=0, Step=1, Count=nx)
series_2 = Series(Start=0, Step=1, Count=nx)
thickness = Slider(5, range=0..5)
unit_z = UnitZ(Factor=thickness)
construct_point = ConstructPoint(XCoordinate=series_2, YCoordinate=graft(series), ZCoordinate=0)
deconstruct = Deconstruct(Point=construct_point)  # -> XComponent, YComponent, ZComponent
ghpython_script = GhPythonScript(x=deconstruct.XComponent, y=deconstruct.YComponent, count=nx)  # -> out, z
# ---------- ghpython_script: Python ----------
from math import *
import random

random.seed(22)
r_points = [
    (random.random() * count, random.random() * count)
    for k in range(10)
]

min_distance = float('inf')
closest_point = r_points[0]

for r_point in r_points:
    r_x, r_y = r_point
    distance = ((x - r_x) ** 2 + (y - r_y) ** 2) ** 0.5 
    
    if distance < min_distance:
        min_distance = distance
        closest_point = r_point
    
z = ((x-closest_point[0]) ** 2 + (y - closest_point[1]) ** 2)
z = z ** 0.5
z = z % 5
# ---------- end ghpython_script ----------
bounds = Bounds(Numbers=flatten(ghpython_script.z))
deconstruct_domain = DeconstructDomain(Domain=bounds)  # -> Start, End
construct_point_2 = ConstructPoint(XCoordinate=deconstruct.XComponent, YCoordinate=deconstruct.YComponent, ZCoordinate=ghpython_script.z)
subtraction = Subtraction(A=deconstruct_domain.End, B=deconstruct_domain.Start)

# ---- group: Depth
panel = Panel(subtraction)

# ----
surface_from_points = SurfaceFromPoints(Points=flatten(construct_point_2), UCount=nx, Interpolate=Toggle(False))
extrude = Extrude(Base=surface_from_points, Direction=unit_z)
mesh_brep = MeshBrep(
    Brep=extrude,
    Settings={GridMaxCount=0, GridMinCount=16, JaggedSeams=False, MaxEdgeLength=0, MinEdgeLength=0.0001, MinTolerance=0, Refine=True, RefineAngle=0, RelativeTolerance=0.65, SimplePlanes=True, Tolerance=0})
panel_2 = Panel(construct_point)
custom_preview = CustomPreview(Geometry=extrude, Material=ColourSwatch(SwatchColor=RGB(201, 34, 34)))
