# Grasshopper definition assignment-3-hexbomb.gh (Grasshopper 1.0.7)

timer = Timer(TimerInterval=50, Target=timer_2)
timer_2 = GhPythonScript()  # -> out, a; disabled
# ---------- timer_2: Python ----------
__author__ = "user"
__version__ = "2020.10.25"

import rhinoscriptsyntax as rs
import time

a = int(time.time() * 10)
# ---------- end timer_2 ----------
initialize = GhPythonScript(rings=Slider(5, range=2..10))  # -> rhino_points, masses, velocities
# ---------- initialize: Python ----------
import rhinoscriptsyntax as rs
import Rhino as rc
        
from math import *
        
class Point(object):
    def __init__(self, x=0, y=0, z=0):
        self.x = x
        self.y = y
        self.z = z
                
    def to_tuple(self):
        return self.x, self.y, self.z
            
    def __repr__(self):
        return 'Point(%s,%s,%s)' % self.to_tuple()
        
def poly_points(r=15, num_points=20, sides=6):
    turn_angle = 2 * pi / sides
    points = []
        
    for k in range(num_points):
        angle = 2 * pi * k / num_points
        turns = angle // turn_angle
        next_turns = turns + 1
        
        # points for polygon edge
        y1 = r * sin(next_turns * turn_angle)
        x1 = r * cos(next_turns * turn_angle)
        y0 = r * sin(turns * turn_angle)
        x0 = r * cos(turns * turn_angle)
        
        m = (y1 - y0) / (x1 - x0)
        c = y0 - m * x0
                
        x = c / (tan(angle) - m)
        y = tan(angle) * x
        points.append(Point(x,y))
        
    return points
        
        
def poly_dist(r=15, sides=6, angle=0):
    turn_angle = 2 * pi / sides
    points = []
        
    assert angle < 2 * pi
    turns = angle // turn_angle
    next_turns = turns + 1
        
    # points for polygon edge
    y1 = r * sin(next_turns * turn_angle)
    x1 = r * cos(next_turns * turn_angle)
    y0 = r * sin(turns * turn_angle)
    x0 = r * cos(turns * turn_angle)
        
    m = (y1 - y0) / (x1 - x0)
    c = y0 - m * x0
                
    x = c / (tan(angle) - m)
    y = tan(angle) * x
    distance = (x**2 + y**2) ** 0.5
    return distance
        
        
        
def hexMesh(radius=10, point_density=2/6, rings=5, sides=6):
    mesh = rc.Geometry.Mesh()
    total_velocities = []
    total_points = []
    rhino_points = []
    total_masses = []
    faces = []
            
    for n in range(rings):    
        ring_radius = (n + 1) * radius / rings
        num_points = int(ring_radius / point_density)
        points = poly_points(ring_radius, num_points, sides)
       
        total_velocities.extend([[0,0,0]] * num_points)
        total_points.extend(points)
        
        if n == rings - 1:
            total_masses.extend([0] * num_points)
        else:
            mass = 1 - (n + 1) / rings
            print(mass)
            total_masses.extend([mass] * num_points)
                
    for v in total_points:
        rhino_points.append(
            rc.Geometry.Point3d(*v.to_tuple())
        )
            
    total_masses.append(1 / rings)
    total_velocities.append([0,0,0])
    rhino_points.append(
        rc.Geometry.Point3d(0,0,0)
    )
        
    return rhino_points, total_masses, total_velocities
            
rhino_points, masses, velocities = hexMesh(
    rings=int(rings)
)
# ---------- end initialize ----------
update = Button()
reset = Button()
delaunay_mesh = DelaunayMesh(Points=flatten(initialize.rhino_points), Plane=PlaneXY(0, 0, 0))
spring_scale = Slider(0.037647, range=0..1)
step = Slider(0.045936, range=0..1)
gravity = Slider(0.925, range=0..10)
drag = Slider(0.68, range=0..1)
load_and_integrate = GhPythonScript(
    reset=reset,
    time=timer_2.a,
    update=update,
    start_points=initialize.rhino_points,
    start_masses=initialize.masses,
    start_velocities=initialize.velocities)  # -> output, points, masses, velocities, state, out_faces, gate, test, p_time; inputs start_points: tree of Point3d, start_masses: tree, start_velocities: tree
# ---------- load_and_integrate: Python ----------
"""
Provides a scripting component.
Inputs:
    x: The x script variable
    y: The y script variable
Output:
    a: The a output variable
"""

__author__ = "user"
__version__ = "2020.10.22"

import Rhino
import rhinoscriptsyntax as rs
import ast

gate = 0
state = 0
out_faces = []
p_time = -1

if reset:
    points = start_points
    masses = start_masses
    velocities = start_velocities
    Rhino.RhinoDoc.ActiveDoc.Notes = ""
else:
    data = Rhino.RhinoDoc.ActiveDoc.Notes
    # print(data)
    
    if data is None:
        points = start_points
        masses = start_masses
        velocities = start_velocities
        state = 1
    else:
        gate = 1
        state = 2
        data = eval(data)
        l_velocities = data['velocities']
        velocities = l_velocities
        
        face_data = data['faces']
        out_faces = [
            Rhino.Geometry.MeshFace(*face)
            for face in face_data
        ]
        # print(out_faces)
        
        b_velocities = [
            Rhino.Geometry.Vector3d(*l_velocities[k])
            for k in range(len(l_velocities))
        ]
        
        l_points = data['points']
        points = [
            Rhino.Geometry.Point3d(*l_points[k])
            for k in range(len(l_points))
        ]
        
        masses = data['masses']
        p_time = data['time']

test = time
# print(velocities)
# print(state)
# ---------- end load_and_integrate ----------
mesh_edges = MeshEdges(Mesh=delaunay_mesh)  # -> NakedEdges, InteriorEdges, NonManifoldEdges
deconstruct_mesh = DeconstructMesh(Mesh=delaunay_mesh)  # -> Vertices, Faces, Colours, Normals
vector_length = VectorLength(Vector=mesh_edges.InteriorEdges)
stream_filter = StreamFilter(Gate=load_and_integrate.gate, Stream0=deconstruct_mesh.Faces, Stream1=load_and_integrate.out_faces)
construct_mesh = ConstructMesh(Vertices=load_and_integrate.points, Faces=stream_filter)
average = Average(Input=vector_length)
calculate = GhPythonScript(
    faces=stream_filter,
    points=load_and_integrate.points,
    mesh=construct_mesh,
    velocities=load_and_integrate.velocities,
    masses=load_and_integrate.masses,
    update=update,
    spring_scale=spring_scale,
    gravity=gravity,
    step=step,
    time=timer_2.a,
    p_time=load_and_integrate.p_time,
    mean_edge_length=average,
    drag=drag)  # -> output, n_velocities, forces, final_velocities; inputs faces: list, points: tree, mesh: Mesh, velocities: list, masses: list
# ---------- calculate: Python ----------
__author__ = "user"
__version__ = "2020.10.25"

import rhinoscriptsyntax as rs
import Rhino

edge_mappings = {}
# print(masses)

for k in range(len(mesh.Faces)):
    face = mesh.Faces[k]
    
    for i in range(3):
        vertex_index = face[i]
        if vertex_index not in edge_mappings:
            edge_mappings[vertex_index] = []
        
        edge_mappings[vertex_index].append(k)
        
forces = []

for k in range(len(mesh.Vertices)):
    point = mesh.Vertices[k]
    x, y, z = point.X, point.Y, point.Z
    mass = masses[k]
    
    connected_faces = edge_mappings[k]
    connected_vertices = []
    
    for i in range(len(connected_faces)):
        face_index = connected_faces[i]
        face = mesh.Faces[face_index]
        
        for j in range(3):
            vertex_index = face[j]
            if vertex_index == k:
                pass 
            elif vertex_index not in connected_vertices:
                connected_vertices.append(vertex_index)
    
    sum_x, sum_y, sum_z = 0, 0, 0
    strength = 1
    
    # print(k, [x,y,z], connected_vertices)
    for i in range(len(connected_vertices)):
        other_index = connected_vertices[i]
        o_vertex = mesh.Vertices[i]
        o_mass = masses[i]
        print(o_mass, i)
        
        if o_mass == 0:
            strength = 100
        else:
            strength = 1
        
        # print(o_mass)
        ox, oy, oz = o_vertex.X, o_vertex.Y, o_vertex.Z
        dist_x, dist_y, dist_z = x - ox, y - oy, z - oz
        
        length = (dist_x ** 2 + dist_y ** 2 + dist_z ** 2) ** 0.5
        scale = abs(length - mean_edge_length) / mean_edge_length
        scale = -1 / scale if scale < 0 else scale
        
        # scale = scale * 2.718 ** abs(scale)
        
        sum_x += -spring_scale * dist_x * scale * strength
        sum_y += -spring_scale * dist_y * scale * strength
        sum_z += -spring_scale * dist_z * scale * strength
    
    g_force = gravity * 1 / (z+1)
    if z > 10:
        g_force = 0
    
    sum_z += g_force
    velocity = velocities[k]
    sum_x -= drag * velocity[0]
    sum_y -= drag * velocity[1]
    sum_z -= drag * velocity[2]
    
    force = Rhino.Geometry.Vector3d(sum_x, sum_y, sum_z)
    forces.append(force)

# velocities = velocities.Branch(0);
n_velocities = []

# print(velocities)
for k in range(len(velocities)):
    velocity = velocities[k]
    mass = masses[k]
    # print(velocity)
    
    if mass == 0:
        inv_mass = 0
    else:
        inv_mass = 1 / mass
        
    new_velocity = [
        step * inv_mass * forces[k][0] + velocity[0],
        step * inv_mass * forces[k][1] + velocity[1],
        step * inv_mass * forces[k][2] + velocity[2]
    ]
    
    n_velocities.append(Rhino.Geometry.Vector3d(
        *new_velocity
    ))

print('NNN', len(n_velocities))

if update or ((p_time > 0) and (p_time != time)):
    py_velocities = [
        [velocity.X, velocity.Y, velocity.Z]
        for velocity in n_velocities
    ]
    py_masses = [masses[k] for k in range(len(masses))]
    print(len(py_velocities))
    
    py_points = [[
        mesh.Vertices[k].X + step * py_velocities[k][0],
        mesh.Vertices[k].Y + step * py_velocities[k][1],
        mesh.Vertices[k].Z + step * py_velocities[k][2]
        ] for k in range(len(mesh.Vertices))
    ]
    
    py_faces = [
        [faces[k][0], faces[k][1], faces[k][2]]
        for k in range(len(faces))
    ]
    
    # print('PY-FACES', py_faces)
    
    save_state = {
        'points': py_points,
        'masses': py_masses,
        'velocities': py_velocities,
        'faces': py_faces,
        'time': time
    }
    
    # print(faces)
    # print('VELOCITIES', py_velocities)
    # print(save_state)
    Rhino.RhinoDoc.ActiveDoc.Notes = str(save_state)

new_velocities = n_velocities
# print(len(mesh.Vertices))
# print(new_velocities)
final_velocities = new_velocities

# print(mesh.Faces[2][0])
# print(len(mesh.Vertices))
# print(mesh.Vertices[0].Y)
# ---------- end calculate ----------
item_index = ItemIndex(List=load_and_integrate.masses, Item=deconstruct_mesh.Vertices)
text_tag_3d = TextTag3D(Location=load_and_integrate.points, Text=load_and_integrate.masses, Size=0.5, Justification=7)
show_velocities = VectorDisplayEx(
    Point=load_and_integrate.points,
    Vector=calculate.final_velocities,
    Colour=ColourSwatch(SwatchColor=RGB(64, 255, 242)),
    Width=1)
show_forces = VectorDisplayEx(Point=load_and_integrate.points, Vector=calculate.forces, Colour=ColourSwatch(SwatchColor=RGB(36, 255, 123)), Width=1)
