# Grasshopper definition assignment-3-martian-variations.gh (Grasshopper 1.0.7)

# generate terrain and initial mesh
number_slider = Slider(5, range=3..10)

initiali_mesh = GhPythonScript(y_offset=Slider(52, range=1..100), x_offset=Slider(55, range=1..100), rings=Slider(3, range=2..10), sides=number_slider)  # -> rhino_points, masses, velocities
# ---------- initiali_mesh: Python ----------
import rhinoscriptsyntax as rs
import Rhino as rc
        
from math import *
import random

random.seed(20)

        
class Point(object):
    def __init__(self, x=0, y=0, z=0):
        self.x = x
        self.y = y
        self.z = z
                
    def to_tuple(self):
        return self.x, self.y, self.z
            
    def __repr__(self):
        return 'Point(%s,%s,%s)' % self.to_tuple()
        
def poly_points(
    r=15, num_points=20, sides=6, x_offset=0, y_offset=0
):
    turn_angle = 2 * pi / sides
    points = []
        
    for k in range(num_points):
        angle = 2 * pi * k / num_points
        turns = angle // turn_angle
        next_turns = turns + 1
        
        # points for polygon edge
        y1 = r * sin(next_turns * turn_angle)
        x1 = r * cos(next_turns * turn_angle)
        y0 = r * sin(turns * turn_angle)
        x0 = r * cos(turns * turn_angle)
        
        m = (y1 - y0) / (x1 - x0)
        c = y0 - m * x0
                
        x = c / (tan(angle) - m)
        y = tan(angle) * x
        points.append(Point(
            x + x_offset, y + y_offset, random.random()
        ))
        
    return points
        
        
def poly_dist(r=15, sides=6, angle=0):
    turn_angle = 2 * pi / sides
    points = []
        
    assert angle < 2 * pi
    turns = angle // turn_angle
    next_turns = turns + 1
        
    # points for polygon edge
    y1 = r * sin(next_turns * turn_angle)
    x1 = r * cos(next_turns * turn_angle)
    y0 = r * sin(turns * turn_angle)
    x0 = r * cos(turns * turn_angle)
        
    m = (y1 - y0) / (x1 - x0)
    c = y0 - m * x0
                
    x = c / (tan(angle) - m)
    y = tan(angle) * x
    distance = (x**2 + y**2) ** 0.5
    return distance
        
        
        
def hexMesh(
    radius=10, point_density=2/6, rings=5, sides=6,
    x_offset=0, y_offset=0
):
    mesh = rc.Geometry.Mesh()
    total_velocities = []
    total_points = []
    rhino_points = []
    total_masses = []
    faces = []
            
    for n in range(rings):    
        ring_radius = (n + 1) * radius / rings
        num_points = int(ring_radius / point_density)
        points = poly_points(
            ring_radius, num_points, sides,
            x_offset=x_offset, y_offset=y_offset
        )
       
        total_velocities.extend([[0,0,0]] * num_points)
        total_points.extend(points)
        
        if n == rings - 1:
            total_masses.extend([0] * num_points)
        else:
            mass = 1 - (n + 1) / rings
            print(mass)
            total_masses.extend([mass] * num_points)
                
    for v in total_points:
        rhino_points.append(
            rc.Geometry.Point3d(*v.to_tuple())
        )
            
    total_masses.append(1)
    total_velocities.append([0,0,0])
    rhino_points.append(
        rc.Geometry.Point3d(x_offset, y_offset, 0)
    )
        
    return rhino_points, total_masses, total_velocities
            
rhino_points, masses, velocities = hexMesh(
    rings=int(rings), x_offset=x_offset, y_offset=y_offset,
    sides=sides
)
# ---------- end initiali_mesh ----------
make_terrain = MakeTerrain(point=initiali_mesh.rhino_points)  # -> x, y, z, surface
align_base_to_terrain = ConstructPoint(XCoordinate=make_terrain.x, YCoordinate=make_terrain.y, ZCoordinate=make_terrain.z)
show_terrain = CustomPreview(
    Geometry=make_terrain.surface,
    Material={diffuse=RGB(165, 54, 39), emission=RGB(0, 0, 0), shine=0, specular=RGB(0, 0, 0), transparency=0})

timer = Timer(TimerInterval=100, Target=timer_2)  # disabled
timer_2 = GhPythonScript()  # -> out, a
# ---------- timer_2: Python ----------
__author__ = "user"
__version__ = "2020.10.25"

import rhinoscriptsyntax as rs
import time

a = int(time.time() * 100)
# ---------- end timer_2 ----------
update = Button()
reset = Button()
delaunay_mesh = DelaunayMesh(Points=flatten(align_base_to_terrain), Plane=PlaneXY(0, 0, 0))

# ----
# get average length of edges in mesh
mesh_edges = MeshEdges(Mesh=delaunay_mesh)  # -> NakedEdges, InteriorEdges, NonManifoldEdges
vector_length = VectorLength(Vector=mesh_edges.InteriorEdges)
average_edge_length = Average(Input=vector_length)

spring_scale = Slider(0.846983, range=0..1)
step = Slider(0.173154, range=0..1)
gravity = Slider(4.473, range=0..10)
drag = Slider(0.451, range=0..1)
load_and_integrate = GhPythonScript(
    reset=reset,
    time=timer_2.a,
    update=update,
    start_points=initiali_mesh.rhino_points,
    start_masses=initiali_mesh.masses,
    start_velocities=initiali_mesh.velocities)  # -> output, points, masses, velocities, state, out_faces, gate, test, p_time; inputs start_points: tree of Point3d, start_masses: tree, start_velocities: tree
# ---------- load_and_integrate: Python ----------
import Rhino
import rhinoscriptsyntax as rs
import ast

gate, state, out_faces, p_time = 0, 0, [], -1

if reset:
    # reset points
    points = start_points
    masses = start_masses
    velocities = start_velocities
    Rhino.RhinoDoc.ActiveDoc.Notes = ""
else:
    data = Rhino.RhinoDoc.ActiveDoc.Notes
    # print(data)
    
    if data is None:
        # reset points if thino docs is empty
        points = start_points
        masses = start_masses
        velocities = start_velocities
        state = 1
    else:
        # parse rhino docs
        gate = 1
        state = 2
        data = eval(data)
        l_velocities = data['velocities']
        velocities = l_velocities        
        face_data = data['faces']

        out_faces = [
            Rhino.Geometry.MeshFace(*face)
            for face in face_data
        ]
        b_velocities = [
            Rhino.Geometry.Vector3d(*l_velocities[k])
            for k in range(len(l_velocities))
        ]        
        l_points = data['points']
        points = [
            Rhino.Geometry.Point3d(*l_points[k])
            for k in range(len(l_points))
        ]
        
        masses = data['masses']
        p_time = data['time']
# ---------- end load_and_integrate ----------
deconstruct_mesh = DeconstructMesh(Mesh=delaunay_mesh)  # -> Vertices, Faces, Colours, Normals
choose_loaded_initial_mesh = StreamFilter(Gate=load_and_integrate.gate, Stream0=deconstruct_mesh.Faces, Stream1=load_and_integrate.out_faces)
construct_mesh = ConstructMesh(Vertices=load_and_integrate.points, Faces=choose_loaded_initial_mesh)
calculate_velocity_forces_save = GhPythonScript(
    faces=choose_loaded_initial_mesh,
    points=load_and_integrate.points,
    mesh=construct_mesh,
    velocities=load_and_integrate.velocities,
    masses=load_and_integrate.masses,
    update=update,
    spring_scale=spring_scale,
    gravity=gravity,
    step=step,
    time=timer_2.a,
    p_time=load_and_integrate.p_time,
    mean_edge_length=average_edge_length,
    drag=drag)  # -> output, forces, final_velocities; inputs faces: list, points: tree, mesh: Mesh, velocities: list, masses: list
# ---------- calculate_velocity_forces_save: Python ----------
import rhinoscriptsyntax as rs
import Rhino

edge_mappings = {}
# print(masses)

for k in range(len(mesh.Faces)):
    face = mesh.Faces[k]
    
    for i in range(3):
        vertex_index = face[i]
        if vertex_index not in edge_mappings:
            edge_mappings[vertex_index] = []
        
        edge_mappings[vertex_index].append(k)
        
forces = []

for k in range(len(mesh.Vertices)):
    point = mesh.Vertices[k]
    x, y, z = point.X, point.Y, point.Z
    mass = masses[k]
    
    connected_faces = edge_mappings[k]
    connected_vertices = []
    
    for i in range(len(connected_faces)):
        face_index = connected_faces[i]
        face = mesh.Faces[face_index]
        
        for j in range(3):
            vertex_index = face[j]
            if vertex_index == k:
                pass 
            elif vertex_index not in connected_vertices:
                connected_vertices.append(vertex_index)
    
    sum_x, sum_y, sum_z = 0, 0, 0
    strength = 1
    
    # print(connected_vertices)
    # print(k, [x,y,z], connected_vertices)
    for i in range(len(connected_vertices)):
        other_index = connected_vertices[i]
        o_vertex = mesh.Vertices[other_index]
        o_mass = masses[other_index]
        # print(o_mass, other_index)
        
        # print(o_mass)
        ox, oy, oz = o_vertex.X, o_vertex.Y, o_vertex.Z
        dist_x, dist_y, dist_z = x - ox, y - oy, z - oz
        
        length = (dist_x ** 2 + dist_y ** 2 + dist_z ** 2) ** 0.5
        scale = abs(length - mean_edge_length) / mean_edge_length
        scale = -1 / scale if scale < 0 else scale
        
        # scale = scale * 2.718 ** abs(scale)
        
        sum_x += -spring_scale * dist_x * scale * strength
        sum_y += -spring_scale * dist_y * scale * strength
        sum_z += -spring_scale * dist_z * scale * strength
    
    g_force = gravity * 1 / (z+1)
    # if z > 10: g_force = 0
    
    sum_z += g_force
    velocity = velocities[k]
    sum_x -= drag * velocity[0]
    sum_y -= drag * velocity[1]
    sum_z -= drag * velocity[2]
    
    force = Rhino.Geometry.Vector3d(sum_x, sum_y, sum_z)
    forces.append(force)

# velocities = velocities.Branch(0);
n_velocities = []

# print(velocities)
for k in range(len(velocities)):
    velocity = velocities[k]
    mass = masses[k]
    # print(velocity)
    
    if mass == 0:
        inv_mass = 0
    else:
        inv_mass = 1 / mass
        
    new_velocity = [
        step * inv_mass * forces[k][0] + velocity[0],
        step * inv_mass * forces[k][1] + velocity[1],
        step * inv_mass * forces[k][2] + velocity[2]
    ]
    
    n_velocities.append(Rhino.Geometry.Vector3d(
        *new_velocity
    ))

print('NNN', len(n_velocities))

if update or ((p_time > 0) and (p_time != time)):
    py_velocities = [
        [velocity.X, velocity.Y, velocity.Z]
        for velocity in n_velocities
    ]
    py_masses = [masses[k] for k in range(len(masses))]
    print(len(py_velocities))
    
    py_points = [[
        mesh.Vertices[k].X + step * py_velocities[k][0],
        mesh.Vertices[k].Y + step * py_velocities[k][1],
        mesh.Vertices[k].Z + step * py_velocities[k][2]
        ] for k in range(len(mesh.Vertices))
    ]
    
    py_faces = [
        [faces[k][0], faces[k][1], faces[k][2]]
        for k in range(len(faces))
    ]
    
    # print('PY-FACES', py_faces)
    
    save_state = {
        'points': py_points,
        'masses': py_masses,
        'velocities': py_velocities,
        'faces': py_faces,
        'time': time
    }
    
    # print(faces)
    # print('VELOCITIES', py_velocities)
    # print(save_state)
    Rhino.RhinoDoc.ActiveDoc.Notes = str(save_state)

new_velocities = n_velocities
final_velocities = new_velocities
# ---------- end calculate_velocity_forces_save ----------
show_shell = CustomPreview(
    Geometry=construct_mesh,
    Material={diffuse=RGB(255, 187, 12), emission=RGB(0, 0, 0), shine=1, specular=RGB(255, 255, 255), transparency=0})
item_index = ItemIndex(List=load_and_integrate.masses, Item=deconstruct_mesh.Vertices)
make_spikes = MakeSpikes(mesh=construct_mesh)
show_vertex_indices = TextTag3D(Location=load_and_integrate.points, Text=load_and_integrate.masses, Size=0.5, Justification=7)  # disabled
show_velocities = VectorDisplayEx(
    Point=load_and_integrate.points,
    Vector=calculate_velocity_forces_save.final_velocities,
    Colour=ColourSwatch(SwatchColor=RGB(64, 255, 242)),
    Width=1)  # disabled
show_spikes = CustomPreview(
    Geometry=make_spikes,
    Material={diffuse=RGB(255, 73, 37), emission=RGB(0, 0, 0), shine=1, specular=RGB(0, 0, 0), transparency=0.1152737811})
show_forces = VectorDisplayEx(
    Point=load_and_integrate.points,
    Vector=calculate_velocity_forces_save.forces,
    Colour=ColourSwatch(SwatchColor=RGB(36, 255, 123)),
    Width=1)

# ==== cluster MakeSpikes
mesh = ClusterInput()
deconstruct_mesh = DeconstructMesh(Mesh=mesh)  # -> Vertices, Faces, Colours, Normals
face_normals = FaceNormals(Mesh=mesh)  # -> Centers, Normals
deconstruct_face = DeconstructFace(Face=deconstruct_mesh.Faces)  # -> CornerA, CornerB, CornerC, CornerD
list_item = ListItem(List=deconstruct_mesh.Vertices, Index=deconstruct_face.CornerA, Wrap=True)
list_item_2 = ListItem(List=deconstruct_mesh.Vertices, Index=deconstruct_face.CornerB, Wrap=True)
list_item_3 = ListItem(List=deconstruct_mesh.Vertices, Index=deconstruct_face.CornerC, Wrap=True)
vector_2pt = Vector2Pt(PointA=list_item, PointB=list_item_3, Unitize=False)  # -> Vector, Length
vector_2pt_2 = Vector2Pt(PointA=list_item, PointB=list_item_2, Unitize=False)  # -> Vector, Length
vector_2pt_3 = Vector2Pt(PointA=list_item, PointB=list_item_2, Unitize=False)  # -> Vector, Length
length = VectorLength(Vector=vector_2pt_2.Vector)
length_2 = VectorLength(Vector=vector_2pt.Vector)
length_3 = VectorLength(Vector=vector_2pt_3.Vector)
combine_data = CombineData(Input0=length, Input1=length_2, Input2=length_3)  # -> graft(Result), Index
vector_mean = Average(Input=combine_data.Result)  # -> flatten(ArithmeticMean)
multiplication = Multiplication(A=vector_mean, B=Slider(0.97, range=0..2))
amplitude = Amplitude(Vector=flatten(face_normals.Normals), Amplitude=multiplication)
vector_display_ex = VectorDisplayEx(Point=face_normals.Centers, Vector=amplitude, Colour=RGB(0, 0, 0), Width=2)
addition = Addition(A=amplitude, B=face_normals.Centers)
combine_faces = GhPythonScript(a=face_normals.Centers, b=list_item_2, c=list_item_3, d=addition, e=list_item)  # -> out, spike; inputs a: Point3d, b: Point3d, c: Point3d, d: Point3d
# ---------- combine_faces: Python ----------
__author__ = "user"
__version__ = "2020.10.26"

import rhinoscriptsyntax as rs

print(a,b,c,d)
spike = (a,b,c,d,e)
# ---------- end combine_faces ----------
delaunay_mesh = DelaunayMesh(Points=combine_faces.spike, Plane=PlaneXY(0, 0, 0))
mesh_2 = GhPythonScript(mesh=delaunay_mesh)  # -> out, a; inputs mesh: Mesh
# ---------- mesh_2: Python ----------
__author__ = "user"
__version__ = "2020.10.26"

import rhinoscriptsyntax as rs

mesh.FillHoles()
a = mesh
# ---------- end mesh_2 ----------
mesh_3 = Mesh(mesh_2.a)
mesh_4 = ClusterOutput(mesh_3)

# ==== cluster MakeTerrain

# ---- group: Width
nx = Slider(96, range=2..100)

# ----
series = Series(Start=0, Step=1, Count=nx)
series_2 = Series(Start=0, Step=1, Count=nx)
construct_point = ConstructPoint(XCoordinate=series, YCoordinate=graft(series_2), ZCoordinate=0)
number_slider = Slider(7.03, range=0..10)
number_slider_2 = Slider(12, range=1..50)
number_slider_3 = Slider(92, range=1..100)
number_slider_4 = Slider(1.313546, range=0..10)
number_slider_5 = Slider(0.96341, range=0..10)
point = ClusterInput()
deconstruct = Deconstruct(Point=construct_point)  # -> XComponent, YComponent, ZComponent
deconstruct_2 = Deconstruct(Point=point)  # -> XComponent, YComponent, ZComponent
assign_z_value_for_base = GhPythonScript(
    x=deconstruct_2.XComponent,
    y=deconstruct_2.YComponent,
    count=nx,
    multiplier=number_slider,
    num_points=number_slider_2,
    seed=number_slider_3,
    min_weight=number_slider_4,
    dist_multiplier=number_slider_5)  # -> out, z
# ---------- assign_z_value_for_base: Python ----------
from math import *
import random

random.seed(22)
num_points = int(num_points)
# num_points = 10

r_points = [
    (random.random() * count, random.random() * count)
    for k in range(num_points)
]

weights = [
    min_weight + multiplier * random.random() 
    for k in range(num_points)
]

min_distance = float('inf')
closest_point = r_points[0]
closest_index = 0
distances = []

for k in range(len(r_points)):
    r_point = r_points[k]
    r_x, r_y = r_point
    
    distance = ((x - r_x) ** 2 + (y - r_y) ** 2) ** 0.5
    distances.append(distance)
    
    if distance < min_distance:
        min_distance = distance
        closest_point = r_point
        closest_index = k
    
z = ((x-closest_point[0]) ** 2 + (y - closest_point[1]) ** 2)
z = z ** 0.5

avg_distance = sum(distances) / len(distances)
weight = weights[closest_index]
z = (z * weight) % (dist_multiplier * avg_distance / min_distance)
# ---------- end assign_z_value_for_base ----------
assignment_2 = GhPythonScript(
    x=deconstruct.XComponent,
    y=deconstruct.YComponent,
    count=nx,
    multiplier=number_slider,
    num_points=number_slider_2,
    seed=number_slider_3,
    min_weight=number_slider_4,
    dist_multiplier=number_slider_5)  # -> out, z; same code as assign_z_value_for_base
construct_point_2 = ConstructPoint(XCoordinate=deconstruct.XComponent, YCoordinate=deconstruct.YComponent, ZCoordinate=assignment_2.z)
y = ClusterOutput(deconstruct_2.YComponent)
x = ClusterOutput(deconstruct_2.XComponent)
z = ClusterOutput(assign_z_value_for_base.z)
surface_from_points = SurfaceFromPoints(Points=flatten(construct_point_2), UCount=nx, Interpolate=Toggle(False))
surface = ClusterOutput(surface_from_points)
