# Grasshopper definition assignment-3.gh (Grasshopper 1.0.7)

ghpython_script = GhPythonScript(radius=Slider(13, range=1..20), rings=Slider(37, range=1..100))  # -> out, radius, points
# ---------- ghpython_script: Python ----------
import rhinoscriptsyntax as rs
import Rhino as rc

from math import *

class Point(object):
    def __init__(self, x=0, y=0, z=0):
        self.x = x
        self.y = y
        self.z = z
        
    def to_tuple(self):
        return self.x, self.y, self.z
    
    def __repr__(self):
        return 'Point(%s,%s,%s)' % self.to_tuple()

def poly_points(r=15, num_points=20, sides=6):
    turn_angle = 2 * pi / sides
    points = []

    for k in range(num_points):
        angle = 2 * pi * k / num_points
        turns = angle // turn_angle
        next_turns = turns + 1

        # points for polygon edge
        y1 = r * sin(next_turns * turn_angle)
        x1 = r * cos(next_turns * turn_angle)
        y0 = r * sin(turns * turn_angle)
        x0 = r * cos(turns * turn_angle)

        m = (y1 - y0) / (x1 - x0)
        c = y0 - m * x0
        
        x = c / (tan(angle) - m)
        y = tan(angle) * x
        points.append(Point(x,y))

    return points

def hexMesh(radius=10, num_points=12, rings=14, sides=6):
    mesh = rc.Geometry.Mesh()
    total_points = []
    faces = []
    
    offset = 1
    
    for k in range(num_points- 1):
        v2 = offset + k + 1
        v1 = offset + k
        v0 = offset
        
        faces.append((v0, v1, v2)) 
    
    for n in range(rings):    
        ring_radius = (n + 1) * radius / rings
        points = poly_points(ring_radius, num_points, sides)
        total_points.extend(points)
        
        for k in range(num_points):
            v0 = offset + (k + n * num_points)
            v1 = offset + ((k + 1) % num_points + n * num_points)
            v2 = offset + ((k + 1) % num_points + (n + 1) * num_points)
            v3 = offset + (k + (n + 1) * num_points)
            
            if k < num_points - 1:
                faces.append((v0, v1, v2))
                faces.append((v0, v2, v3))
            else:
                faces.append((v1, v2, v0))
                faces.append((v0, v2, v3))
    
    mesh.Vertices.Add(rc.Geometry.Point3d(*(0,0,0)))
    
    for v in total_points:
        mesh.Vertices.Add(
            rc.Geometry.Point3d(*v.to_tuple())
        )
    
    for face in faces:
        mesh.Faces.AddFace(*face)
        
    return mesh
    
rings = int(rings)
out = hexMesh(radius, rings=rings)

"""
points = [
    (0,0,0), (0,5,0), (5,0,0), (5,5,0), (10,3,11)
]

for v in points:
    mesh.Vertices.Add(rc.Geometry.Point3d(*v))

face = [0,1,2,3]
mesh.Faces.AddFace(*face)
out = mesh
"""
# ---------- end ghpython_script ----------
count = Slider(11, range=2..32)
rectangle = Rectangle({Plane=PlaneXY(-0.09931969643, -0.4350538619, 0), Size=Domain2(u=-5.350352748..5.350352748, v=-6.992818744..6.992818744)})
point = Point(ghpython_script.points)
mesh = Mesh(ghpython_script.out)
noisy = Noisy(count=count, free=rectangle)  # disabled
mesh_2 = Mesh(mesh)
soap = Soap(mesh=mesh_2, free=rectangle)  # -> initial_2, faces_2, edges_2, fans_2
deconstruct_mesh = DeconstructMesh(Mesh=mesh)  # -> Vertices, Faces, Colours, Normals
point_2 = Point(deconstruct_mesh.Vertices)  # disabled
panel = Panel(deconstruct_mesh.Vertices)
panel_2 = Panel(mesh_2)
update = Button()
timer = Timer(TimerInterval=100, Target=control)  # disabled
reset = Button()
control = Control(reset=reset, update=update, initial=soap.initial_2)  # -> positions, velocities, masses

# ---- group: State
velocities = Vector(control.velocities)
positions = Point(control.positions)
masses = Number(control.masses)

# ----
analysis = Analysis(positions=positions, velocities=velocities, masses=masses, edges=soap.edges_2, faces=soap.faces_2, fans=soap.fans_2)
integrate = Integrate(positions=positions, velocities=velocities, masses=masses, forces=analysis)  # -> positions_4, velocities_4, masses_4
enable = BooleanToggle(False)
display = Display(positions=control.positions, velocities=control.velocities, masses=control.masses, forces=analysis, faces=soap.faces_2)
constraint = Constraint(positions=integrate.positions_4, velocities=integrate.velocities_4, masses=integrate.masses_4, enable=enable)  # -> positions_5, velocities_5, masses_5
persist = Persist(positions=constraint.positions_5, velocities=constraint.velocities_5, masses=constraint.masses_5)

# ==== cluster Integrate
positions = ClusterInput()
velocities = ClusterInput()
masses = ClusterInput()
forces = ClusterInput()
forces_2 = Vector(forces)

# ---- group: State
velocities_2 = Vector(velocities)
positions_2 = Point(positions)
masses_2 = Number(masses)

# ---- group: Time Step
dt = Slider(0.05, range=0.001..0.1)

# ---- group: Acceleration
a_b = GhPythonScript(A=forces_2, B=masses_2)  # -> C
# ---------- a_b: Python ----------
C = 0 * A if B == 0 else A / B
# ---------- end a_b ----------

# ---- group: Acceleration * dt
multiplication = Multiplication(A=a_b, B=dt)

# ---- group: Velocity += Acceleration * dt
addition = Addition(A=multiplication, B=velocities_2)

# ---- group: Velocity * dt
multiplication_2 = Multiplication(A=addition, B=dt)

# ---- group: Position += Velocity * dt
addition_2 = Addition(A=multiplication_2, B=positions_2)

# ---- group: States
positions_3 = Point(addition_2)
velocities_3 = Vector(addition)
masses_3 = Number(masses_2)

# ----
positions_4 = ClusterOutput(positions_3)
velocities_4 = ClusterOutput(velocities_3)
masses_4 = ClusterOutput(masses_3)

# ==== cluster Constraint
positions = ClusterInput()
velocities = ClusterInput()
masses = ClusterInput()
enable = ClusterInput()

# ---- group: States
velocities_2 = Vector(velocities)
positions_2 = Point(positions)
masses_2 = Number(masses)

# ----
enable_2 = Boolean(enable)
deconstruct_vector = DeconstructVector(Vector=velocities_2)  # -> XComponent, YComponent, ZComponent
deconstruct = Deconstruct(Point=positions_2)  # -> XComponent, YComponent, ZComponent
limit = Number("25")
clamp = GhPythonScript(Value=deconstruct.XComponent, Limit=limit)  # -> Clamped, Reverse
# ---------- clamp: Python ----------
Clamped = -Limit if( Value < -Limit ) else Limit if( Value > Limit ) else Value
Reverse = -1 if( ( Value < -Limit ) or ( Value > Limit ) ) else 1
# ---------- end clamp ----------
clamp_2 = GhPythonScript(Value=deconstruct.YComponent, Limit=limit)  # -> Clamped, Reverse
# ---------- clamp_2: Python ----------
Clamped = -Limit if( Value < -Limit ) else Limit if( Value > Limit ) else Value
Reverse = -1 if( Value < -Limit or Value > Limit ) else 1
# ---------- end clamp_2 ----------
clamp_3 = GhPythonScript(Value=deconstruct.ZComponent, Limit=limit)  # -> Clamped, Reverse; same code as clamp_2
multiplication = Multiplication(A=deconstruct_vector.YComponent, B=clamp_2.Reverse)
multiplication_2 = Multiplication(A=deconstruct_vector.ZComponent, B=clamp_3.Reverse)
multiplication_3 = Multiplication(A=deconstruct_vector.XComponent, B=clamp.Reverse)
vector_xyz = VectorXYZ(XComponent=multiplication_3, YComponent=multiplication, ZComponent=multiplication_2)  # -> Vector, Length
construct_point = ConstructPoint(XCoordinate=clamp.Clamped, YCoordinate=clamp_2.Clamped, ZCoordinate=clamp_3.Clamped)

# ---- group: States
velocities_3 = Vector(vector_xyz.Vector)
positions_3 = Point(construct_point)
masses_3 = Number(masses_2)

# ----
stream_gate = StreamGate(Stream=limit, Gate=enable_2)  # -> Target0, Target1

# ---- group: Enable / Disable Constraints Bypass
stream_filter = StreamFilter(Gate=enable_2, Stream0=positions_2, Stream1=positions_3)
stream_filter_2 = StreamFilter(Gate=enable_2, Stream0=velocities_2, Stream1=velocities_3)
stream_filter_3 = StreamFilter(Gate=enable_2, Stream0=masses_2, Stream1=masses_3)

# ----
negative = Negative(Value=stream_gate.Target1)
construct_domain = ConstructDomain(DomainStart=negative, DomainEnd=stream_gate.Target1)

# ---- group: States
velocities_4 = Vector(stream_filter_2)
positions_4 = Point(stream_filter)
masses_4 = Number(stream_filter_3)

# ----
velocities_5 = ClusterOutput(velocities_4)
masses_5 = ClusterOutput(masses_4)
positions_5 = ClusterOutput(positions_4)
domain_box = DomainBox(Base=PlaneXY(0, 0, 0), X=construct_domain, Y=construct_domain, Z=construct_domain)
custom_preview = CustomPreview(Geometry=domain_box, Material=ColourSwatch(SwatchColor=RGBA(186, 187, 255, 0)))

# ==== cluster Display
velocities = ClusterInput()
positions = ClusterInput()
masses = ClusterInput()
forces = ClusterInput()
faces = ClusterInput()

# ---- group: State
velocities_2 = Vector(velocities)
positions_2 = Point(positions)
masses_2 = Number(masses)

# ----
forces_2 = Vector(forces)
faces_2 = MeshFace(faces)
construct_mesh = ConstructMesh(Vertices=positions_2, Faces=faces_2)

# ---- group: Force Visualization
scale = Slider(0.01, range=0..100)
multiplication = Multiplication(A=forces_2, B=scale)
vector_display_ex = VectorDisplayEx(Point=positions_2, Vector=multiplication, Colour=ColourSwatch(SwatchColor=RGB(168, 222, 53)), Width=5)

# ---- group: Velocity Visualization
scale_2 = Slider(0.5, range=0..100)
multiplication_2 = Multiplication(A=velocities_2, B=scale_2)
vector_display_ex_2 = VectorDisplayEx(Point=positions_2, Vector=multiplication_2, Colour=ColourSwatch(SwatchColor=RGB(255, 71, 71)), Width=5)

# ==== cluster Control
reset = ClusterInput()
update = ClusterInput()
initial = ClusterInput()
reset_2 = Boolean(reset)
initial_2 = Text(initial)
update_2 = Boolean(update)
gate_or = GateOr(A=reset_2, B=update_2)
load = GhPythonScript(push=gate_or)  # -> data
# ---------- load: Python ----------
import Rhino
data = Rhino.RhinoDoc.ActiveDoc.Notes
# ---------- end load ----------
stream_filter = StreamFilter(Gate=reset_2, Stream0=load, Stream1=initial_2)
unpack = Unpack(text=stream_filter)  # -> positions_2, velocities_2, masses_2
positions = ClusterOutput(unpack.positions_2)
velocities = ClusterOutput(unpack.velocities_2)
masses = ClusterOutput(unpack.masses_2)

# ==== cluster Persist
positions = ClusterInput()
velocities = ClusterInput()
masses = ClusterInput()
pack = Pack(positions=positions, velocities=velocities, masses=masses)
save = GhPythonScript(data=pack)  # -> data
# ---------- save: Python ----------
import Rhino
Rhino.RhinoDoc.ActiveDoc.Notes = data
# ---------- end save ----------

# ==== cluster Soap
mesh = ClusterInput()
free = ClusterInput()
free_2 = Rectangle(free)
topology = Topology(mesh=mesh)  # -> nodes_2, faces, edges_2, fans_2
point = Point(topology.nodes_2)
zero = Zero(positions=topology.nodes_2)
fix = Fix(point=topology.nodes_2, rectangle=free_2)
pack = Pack_2(positions=topology.nodes_2, velocities=zero, masses=fix)
faces = MeshFace(topology.faces)
initial = Text(pack)
edges = Integer(topology.edges_2)
fans = Integer(topology.fans_2)
initial_2 = ClusterOutput(initial)
faces_2 = ClusterOutput(faces)
edges_2 = ClusterOutput(edges)
fans_2 = ClusterOutput(fans)

# ==== cluster Analysis
velocities = ClusterInput()
positions = ClusterInput()
masses = ClusterInput()
edges = ClusterInput()
fans = ClusterInput()
faces = ClusterInput()

# ---- group: Topology
edges_2 = Integer(edges)
faces_2 = MeshFace(faces)
fans_2 = Integer(fans)

# ---- group: State
velocities_2 = Vector(velocities)
positions_2 = Point(positions)
masses_2 = Number(masses)

# ---- group: Forces
g = Slider(-10, range=-10..10)
s = Slider(8, range=0..100)
L = Slider(1, range=0..10)
k = Slider(1, range=0..100)
k_2 = Slider(2, range=0..10)
gravity = Gravity(acceleration=g, mass=masses_2)
springs = Springs(positions=positions_2, rest_length=L, stiffness=k, edges=edges_2)
pressure = Pressure(positions=positions_2, faces=faces_2, fans=fans_2, strength=s)
drag = Drag(velocity=velocities_2, factor=k_2)

# ----
addition = Addition(A=springs, B=drag, C=gravity, D=pressure)
sumforces = Vector(addition)
sumforces_2 = ClusterOutput(sumforces)

# ==== cluster Noisy
count = ClusterInput()
free = ClusterInput()
count_2 = Integer(count)
free_2 = Rectangle(free)
mesh_plane = MeshPlane(Boundary={Plane=PlaneXY(0, 0, 0), Size=Domain2(u=-10..10, v=-10..10)}, WidthCount=count_2, HeightCount=count_2)  # -> Mesh, Area
panel = Panel(free_2)
deconstruct_mesh = DeconstructMesh(Mesh=mesh_plane.Mesh)  # -> Vertices, Faces, Colours, Normals
panel_2 = Panel(deconstruct_mesh.Vertices)
contains = Contains(point=deconstruct_mesh.Vertices, rectangle=free_2)
list_length = ListLength(List=deconstruct_mesh.Vertices)
random = Random(Range=Domain(0, 1), Number=list_length, Seed=2)
integer = Integer(contains)
nakedvertices = NakedVertices(Mesh=mesh_plane.Mesh)  # -> ClothedIndex, NakedIndex, ClothedPts, NakedPts
multiplication = Multiplication(A=random, B=integer)
panel_3 = Panel(integer)
unit_z = UnitZ(Factor=multiplication)
addition = Addition(A=deconstruct_mesh.Vertices, B=unit_z)
construct_mesh = ConstructMesh(Vertices=addition, Faces=deconstruct_mesh.Faces)
weld_mesh = WeldMesh(Mesh=construct_mesh, Angle=3.141592654)
mesh = Mesh(weld_mesh)
mesh_2 = ClusterOutput(mesh)

# ==== cluster Unpack
text = ClusterInput()
text_split = TextSplit(Text=text, Separators=";")
text_split_2 = TextSplit(Text=text_split, Separators=",")
list_item = ListItem(List=text_split_2, Index=0, Wrap=True)  # -> Item, Item1, Item2, Item3, Item4, Item5, Item6
vector_xyz = VectorXYZ(XComponent=list_item.Item3, YComponent=list_item.Item4, ZComponent=list_item.Item5)  # -> Vector, Length
construct_point = ConstructPoint(XCoordinate=list_item.Item, YCoordinate=list_item.Item1, ZCoordinate=list_item.Item2)

# ---- group: States
velocities = Vector(flatten(vector_xyz.Vector))
positions = Point(flatten(construct_point))
masses = Number(flatten(list_item.Item6))

# ----
masses_2 = ClusterOutput(masses)
positions_2 = ClusterOutput(positions)
velocities_2 = ClusterOutput(velocities)

# ==== cluster Pack
positions = ClusterInput()
velocities = ClusterInput()
masses = ClusterInput()

# ---- group: State
positions_2 = Point(positions)
velocities_2 = Vector(velocities)
masses_2 = Number(masses)

# ----
deconstruct_vector = DeconstructVector(Vector=velocities_2)  # -> XComponent, YComponent, ZComponent
deconstruct = Deconstruct(Point=positions_2)  # -> XComponent, YComponent, ZComponent
entwine = Entwine(
    Branch00=deconstruct.XComponent,
    Branch01=deconstruct.YComponent,
    Branch02=deconstruct.ZComponent,
    Branch03=deconstruct_vector.XComponent,
    Branch04=deconstruct_vector.YComponent,
    Branch05=deconstruct_vector.ZComponent,
    Branch06=masses_2,
    FlattenInputs=True)
flip_matrix = FlipMatrix(Data=entwine)
text_join = TextJoin(Text=flip_matrix, Join=",")  # -> flatten(Result)
text_join_2 = TextJoin(Text=text_join, Join=";")
result = ClusterOutput(text_join_2)

# ==== cluster Topology
mesh = ClusterInput()
deconstruct_mesh = DeconstructMesh(Mesh=mesh)  # -> Vertices, Faces, Colours, Normals
edges = Edges(vertices=deconstruct_mesh.Vertices, faces=deconstruct_mesh.Faces)
fans = Fans(vertices=deconstruct_mesh.Vertices, faces=deconstruct_mesh.Faces)
nodes = Point(deconstruct_mesh.Vertices)
nodes_2 = ClusterOutput(nodes)
faces = ClusterOutput(deconstruct_mesh.Faces)
edges_2 = ClusterOutput(edges)
fans_2 = ClusterOutput(fans)

# ==== cluster Pack_2
positions = ClusterInput()
velocities = ClusterInput()
masses = ClusterInput()

# ---- group: States
positions_2 = Point(positions)
velocities_2 = Vector(velocities)
masses_2 = Number(masses)

# ----
deconstruct_vector = DeconstructVector(Vector=velocities_2)  # -> XComponent, YComponent, ZComponent
deconstruct = Deconstruct(Point=positions_2)  # -> XComponent, YComponent, ZComponent
entwine = Entwine(
    Branch00=deconstruct.XComponent,
    Branch01=deconstruct.YComponent,
    Branch02=deconstruct.ZComponent,
    Branch03=deconstruct_vector.XComponent,
    Branch04=deconstruct_vector.YComponent,
    Branch05=deconstruct_vector.ZComponent,
    Branch06=masses_2,
    FlattenInputs=True)
flip_matrix = FlipMatrix(Data=entwine)
text_join = TextJoin(Text=flip_matrix, Join=",")  # -> flatten(Result)
text_join_2 = TextJoin(Text=text_join, Join=";")
result = ClusterOutput(text_join_2)

# ==== cluster Zero
positions = ClusterInput()
positions_2 = Point(positions)
_0 = Integer(0)
multiplication = Multiplication(A=positions_2, B=_0)
velocities = Vector(multiplication)
velocities_2 = ClusterOutput(velocities)

# ==== cluster Fix
rectangle = ClusterInput()
point = ClusterInput()
mass = Slider(1, range=0..1)
contains = Contains(point=point, rectangle=rectangle)
expression = Expression(Contained=contains, Mass=mass, Expression="if( Contained, Mass, 0 )")
masses = Number(expression)
masses_2 = ClusterOutput(masses)

# ==== cluster Gravity
mass = ClusterInput()
acceleration = ClusterInput()
mass_2 = Number(mass)
acceleration_2 = Number(acceleration)
unit_z = UnitZ(Factor=acceleration_2)
negative = Negative(Value=unit_z)
multiplication = Multiplication(A=negative, B=mass_2)
force = Vector(multiplication)
force_2 = ClusterOutput(force)

# ==== cluster Drag
velocity = ClusterInput()
factor = ClusterInput()
velocity_2 = Vector(velocity)
factor_2 = Number(factor)
multiplication = Multiplication(A=velocity_2, B=factor_2)
negative = Negative(Value=multiplication)
force = Vector(negative)
force_2 = ClusterOutput(force)

# ==== cluster Springs
rest_length = ClusterInput()
positions = ClusterInput()
stiffness = ClusterInput()
edges = ClusterInput()
positions_2 = Point(positions)
rest_length_2 = Number(rest_length)
stiffness_2 = Number(stiffness)
edges_2 = Integer(edges)
list_item = ListItem(List=positions_2, Index=edges_2, Wrap=True)

# ---- group: Forces
vector_2pt = Vector2Pt(PointA=list_item, PointB=graft(positions_2), Unitize=False)  # -> Vector, Length
subtraction = Subtraction(A=rest_length_2, B=vector_2pt.Length)
unit_vector = UnitVector(Vector=vector_2pt.Vector)
multiplication = Multiplication(A=subtraction, B=stiffness_2)
multiplication_2 = Multiplication(A=unit_vector, B=multiplication)

# ---- group: Partial Sums
mass_addition = MassAddition(Input=multiplication_2)  # -> flatten(Result), PartialResults
force = Vector(mass_addition.Result)

# ----
force_2 = ClusterOutput(force)

# ==== cluster Pressure
positions = ClusterInput()
faces = ClusterInput()
fans = ClusterInput()
strength = ClusterInput()
positions_2 = Point(positions)
strength_2 = Number(strength)
faces_2 = MeshFace(faces)
fans_2 = Integer(fans)
normals = Normals(vertices=positions_2, faces=faces_2, fans=fans_2)
multiplication = Multiplication(A=normals, B=strength_2)
force = Vector(multiplication)
force_2 = ClusterOutput(force)

# ==== cluster Edges
faces = ClusterInput()
vertices = ClusterInput()
enum = Enum(list=vertices)
faces_2 = MeshFace(faces)
pointinedge = GhPythonScript(T=graft(faces_2), I=enum)  # -> U, V; inputs I: Int32
# ---------- pointinedge: Python ----------
if( T.IsQuad ):
  if( I == T.A ):
    U = T.B
    V = T.D
  else:
    if( I == T.B ):
      U = T.C
      V = T.A
    else:
      if( I == T.C ):
        U = T.D
        V = T.B
      else:
        if( I == T.D ):
          U = T.A
          V = T.C
        else:
          U = -1
          V = -1
else:
  if( I == T.A ):
    U = T.B
    V = T.C
  else:
    if( I == T.B ):
      U = T.C
      V = T.A
    else:
      if( I == T.C ):
        U = T.A
        V = T.B
      else:
        U = -1
        V = -1
# ---------- end pointinedge ----------

# ---- group: Reshape Indices
flip_matrix = FlipMatrix(Data=pointinedge.U)
flip_matrix_2 = FlipMatrix(Data=pointinedge.V)
merge = Merge(Data1=flip_matrix, Data2=flip_matrix_2)

# ---- group: Remove Duplicates
create_set = CreateSet(List=merge)  # -> Set, Map

# ----
integer = Integer(-1)

# ---- group: Remove Invalid
set_difference = SetDifference(SetA=create_set.Set, SetB=graft(integer))

# ----
edges = ClusterOutput(set_difference)

# ==== cluster Fans
vertices = ClusterInput()
faces = ClusterInput()
vertices_2 = Point(vertices)
faces_2 = MeshFace(faces)
deconstruct_face = DeconstructFace(Face=graft(faces_2))  # -> CornerA, CornerB, CornerC, CornerD
enum = Enum(list=vertices_2)
equality = Equality(FirstNumber=deconstruct_face.CornerB, SecondNumber=enum)  # -> Equality, Inequality
equality_2 = Equality(FirstNumber=deconstruct_face.CornerA, SecondNumber=enum)  # -> Equality, Inequality
equality_3 = Equality(FirstNumber=deconstruct_face.CornerC, SecondNumber=enum)  # -> Equality, Inequality
equality_4 = Equality(FirstNumber=deconstruct_face.CornerD, SecondNumber=enum)  # -> Equality, Inequality
gate_or = GateOr(A=equality_2.Equality, B=equality.Equality, C=equality_3.Equality, D=equality_4.Equality)
flip_matrix = FlipMatrix(Data=gate_or)
enum_2 = Enum(list=faces_2)
dispatch = Dispatch(List=enum_2, DispatchPattern=flip_matrix)  # -> ListA, ListB
fans = Integer(dispatch.ListA)
fans_2 = ClusterOutput(fans)

# ==== cluster Contains
rectangle = ClusterInput()
point = ClusterInput()
rectangle_2 = Rectangle(rectangle)
point_2 = Point(point)
deconstruct = Deconstruct(Point=point_2)  # -> XComponent, YComponent, ZComponent
deconstuct_rectangle = DeconstuctRectangle(Rectangle=rectangle_2)  # -> BasePlane, XInterval, YInterval
includes = Includes(Value=deconstruct.XComponent, Domain=deconstuct_rectangle.XInterval)  # -> Includes, Deviation
includes_2 = Includes(Value=deconstruct.YComponent, Domain=deconstuct_rectangle.YInterval)  # -> Includes, Deviation
gate_and = GateAnd(A=includes.Includes, B=includes_2.Includes)
internal = Boolean(gate_and)
internal_2 = ClusterOutput(internal)

# ==== cluster Normals
vertices = ClusterInput()
faces = ClusterInput()
fans = ClusterInput()
vertices_2 = Point(vertices)
fans_2 = Integer(fans)
faces_2 = MeshFace(faces)
deconstruct_face = DeconstructFace(Face=faces_2)  # -> CornerA, CornerB, CornerC, CornerD
list_item = ListItem(List=vertices_2, Index=deconstruct_face.CornerC, Wrap=True)
list_item_2 = ListItem(List=vertices_2, Index=deconstruct_face.CornerB, Wrap=True)
list_item_3 = ListItem(List=vertices_2, Index=deconstruct_face.CornerA, Wrap=True)
subtraction = Subtraction(A=list_item_2, B=list_item_3)
subtraction_2 = Subtraction(A=list_item, B=list_item_2)
cross_product = CrossProduct(VectorA=subtraction, VectorB=subtraction_2, Unitize=False)  # -> Vector, Length
list_item_4 = ListItem(List=cross_product.Vector, Index=fans_2, Wrap=True)
mass_addition = MassAddition(Input=list_item_4)  # -> flatten(Result), PartialResults
unit_vector = UnitVector(Vector=mass_addition.Result)
vector = ClusterOutput(unit_vector)

# ==== cluster Enum
list = ClusterInput()
list_length = ListLength(List=list)
series = Series(Start=0, Step=1, Count=list_length)
series_2 = ClusterOutput(series)
