# Grasshopper definition lord-save-me.gh (Grasshopper 1.0.7)

ghpython_script = GhPythonScript()  # -> rhino_points, masses, velocities
# ---------- ghpython_script: Python ----------
import rhinoscriptsyntax as rs
import Rhino as rc
        
from math import *
        
class Point(object):
    def __init__(self, x=0, y=0, z=0):
        self.x = x
        self.y = y
        self.z = z
                
    def to_tuple(self):
        return self.x, self.y, self.z
            
    def __repr__(self):
        return 'Point(%s,%s,%s)' % self.to_tuple()
        
def poly_points(r=15, num_points=20, sides=6):
    turn_angle = 2 * pi / sides
    points = []
        
    for k in range(num_points):
        angle = 2 * pi * k / num_points
        turns = angle // turn_angle
        next_turns = turns + 1
        
        # points for polygon edge
        y1 = r * sin(next_turns * turn_angle)
        x1 = r * cos(next_turns * turn_angle)
        y0 = r * sin(turns * turn_angle)
        x0 = r * cos(turns * turn_angle)
        
        m = (y1 - y0) / (x1 - x0)
        c = y0 - m * x0
                
        x = c / (tan(angle) - m)
        y = tan(angle) * x
        points.append(Point(x,y))
        
    return points
        
        
def poly_dist(r=15, sides=6, angle=0):
    turn_angle = 2 * pi / sides
    points = []
        
    assert angle < 2 * pi
    turns = angle // turn_angle
    next_turns = turns + 1
        
    # points for polygon edge
    y1 = r * sin(next_turns * turn_angle)
    x1 = r * cos(next_turns * turn_angle)
    y0 = r * sin(turns * turn_angle)
    x0 = r * cos(turns * turn_angle)
        
    m = (y1 - y0) / (x1 - x0)
    c = y0 - m * x0
                
    x = c / (tan(angle) - m)
    y = tan(angle) * x
    distance = (x**2 + y**2) ** 0.5
    return distance
        
        
        
def hexMesh(radius=10, point_density=2/6, rings=5, sides=6):
    mesh = rc.Geometry.Mesh()
    total_velocities = []
    total_points = []
    rhino_points = []
    total_masses = []
    faces = []
            
    for n in range(rings):    
        ring_radius = (n + 1) * radius / rings
        num_points = int(ring_radius / point_density)
        points = poly_points(ring_radius, num_points, sides)
       
        total_velocities.extend([[0,0,0]] * num_points)
        total_points.extend(points)
        
        if n == rings - 1:
            total_masses.extend([0] * num_points)
        else:
            total_masses.extend([1] * num_points)
                
    for v in total_points:
        rhino_points.append(
            rc.Geometry.Point3d(*v.to_tuple())
        )
            
    return rhino_points, total_masses, total_velocities
            
rhino_points, masses, velocities = hexMesh()
# ---------- end ghpython_script ----------
update = Button()
timer = Timer(TimerInterval=100)
reset = Button()
ghpython_script_2 = GhPythonScript(
    reset=reset,
    update=update,
    start_points=ghpython_script.rhino_points,
    start_masses=ghpython_script.masses,
    start_velocities=ghpython_script.velocities)  # -> flatten(points), masses, velocities; inputs start_points: Point3d
# ---------- ghpython_script_2: Python ----------
__author__ = "user"
__version__ = "2020.10.22"

import Rhino
import rhinoscriptsyntax as rs
import ast

if reset:
    points = start_points
    masses = start_masses
    velocities = start_velocities
else:
    data = Rhino.RhinoDoc.ActiveDoc.Notes
    
    try:
        data = eval(data)
    except:
        points = start_points
        masses = start_masses
        velocities = start_velocities
    else:
        velocities = data['velocities']
        points = data['points']
        masses = data['masses']

print(points)
# ---------- end ghpython_script_2 ----------
panel = Panel(ghpython_script.rhino_points)
panel_2 = Panel(ghpython_script.masses)
panel_3 = Panel(ghpython_script_2.velocities)
ghpython_script_3 = GhPythonScript(Points=ghpython_script_2.points, Masses=ghpython_script_2.masses, Velocities=ghpython_script_2.velocities)  # -> Velocities, A
panel_4 = Panel(ghpython_script_2.points)
delaunay_mesh = DelaunayMesh(Points=ghpython_script_2.points, Plane=PlaneXY(0, 0, 0))
deconstruct_mesh = DeconstructMesh(Mesh=delaunay_mesh)  # -> Vertices, Faces, Colours, Normals
