# Grasshopper definition assignment1-bob [Sep-24 '20, 1756].gh (Grasshopper 1.0.7)

number_slider = Slider(100, range=1..100)
series = Series(Start=0, Step=1, Count=number_slider)
panel = Panel(series)
number_slider_2 = Slider(63, range=0..100)
number_slider_3 = Slider(18, range=1..100)
scaling = Slider(17, range=1..100)
series_2 = Series(Start=0, Step=1, Count=10)
division = Division(A=panel, B=number_slider)
expression = Expression(x=division, z=series_2, y=number_slider_2, Expression="(10 * y * (x ^ 2) * cos(2 * pi * x - z) + y * x) % 10")
expression_2 = Expression(x=division, z=number_slider_3, y=scaling, Expression="10 * y * sin(2 * pi * x + z) % 10")
expression_3 = Expression(x=division, z=series_2, y=number_slider_2, Expression="(10 * y/(y+10) * (x ^ 2) * cos(2 * pi * x - z) + y * x) % 10")
expression_4 = Expression(x=division, z=number_slider_3, y=scaling, Expression="y * tan(2 * pi * x - z)% 10")
panel_2 = Panel(division)
series_3 = Series(Start=Slider(1, range=1..10), Step=1, Count=Slider(5, range=1..5))
pt = ConstructPoint(XCoordinate=expression_2, YCoordinate=expression_3, ZCoordinate=expression_4)
panel_3 = Panel(pt)
nurbs = NurbsCurve(Vertices=pt, Degree=series_3, Periodic=False)  # -> Curve, Length, Domain
