# Grasshopper definition assignment1-bob.gh (Grasshopper 1.0.7)

number_slider = Slider(64, range=1..1000)
series = Series(Start=0, Step=1, Count=number_slider)
panel = Panel(series)
number_slider_2 = Slider(40, range=0..100)
number_slider_3 = Slider(49, range=1..100)
scaling = Slider(23, range=1..100)
series_2 = Series(Start=0, Step=1, Count=10)
division = Division(A=panel, B=number_slider)
expression = Expression(x=division, z=series_2, y=number_slider_2, Expression="(10 * y * (x ^ 2) * cos(2 * pi * x - z) + y * x) % 10")
expression_2 = Expression(x=division, z=number_slider_3, y=scaling, Expression="10 * y * sin(2 * pi * x + z) % 10")
expression_3 = Expression(x=division, z=series_2, y=number_slider_2, Expression="(10 * y/(y+10) * (x ^ 2) * cos(2 * pi * x - z) + y * x) % 10")
expression_4 = Expression(x=division, z=number_slider_3, y=scaling, Expression="y * tan(2 * pi * x - z)% 10")
panel_2 = Panel(division)
series_3 = Series(Start=Slider(1, range=1..10), Step=1, Count=Slider(5, range=1..5))
pt = ConstructPoint(XCoordinate=expression_2, YCoordinate=expression_3, ZCoordinate=expression_4)
panel_3 = Panel(pt)
frgb = ColourRGBF(Alpha=1, Red=0, Green=0, Blue=0)
nurbs = NurbsCurve(Vertices=pt, Degree=series_3, Periodic=False)  # -> Curve, Length, Domain
topoly = CurveToPolyline(Curve=nurbs.Curve, ToleranceDistance=0, ToleranceAngle=0)  # -> Polyline, Segments
panel_4 = Panel(nurbs.Curve)
python = GhPythonScript(polyline=topoly.Polyline)  # -> out, a; inputs polyline: Polyline
# ---------- python: Python ----------
__author__ = "user"
__version__ = "2020.09.26"

import rhinoscriptsyntax as rs
import Rhino.Geometry as rg
data = []

# needs type hinting to work
# https://medium.com/generative-design/working-with-geometry-in-python-a256de7bb1b1
for k in range(len(polyline) - 1):
    current_point = polyline[k]
    next_point = polyline[k+1]
    sub_line = rs.AddLine(
        current_point, next_point,
        [100, 200, 22]
    )
# ---------- end python ----------
expression_5 = Expression(x=expression_3, y=Slider(48, range=1..255), Expression="(x+y)%255")
expression_6 = Expression(x=expression_2, y=Slider(188, range=1..255), Expression="(x+y)%255")
panel_5 = Panel(topoly.Polyline)
rgb = ColourRGB(Alpha=Slider(255, range=0..255), Red=expression_5, Green=expression_5, Blue=expression_6)
preview = CustomPreview(Geometry=nurbs.Curve, Material=rgb)
