# Grasshopper definition assignment1-color-monster.gh (Grasshopper 1.0.7)

number_slider = Slider(76, range=1..1000)
series = Series(Start=0, Step=1, Count=number_slider)
panel = Panel(series)
number_slider_2 = Slider(57, range=0..100)
number_slider_3 = Slider(33, range=1..100)
scaling = Slider(39, range=1..100)
series_2 = Series(Start=0, Step=1, Count=10)
division = Division(A=panel, B=number_slider)
expression = Expression(x=division, z=series_2, y=number_slider_2, Expression="(10 * y * (x ^ 2) * cos(2 * pi * x - z) + y * x) % 10")
expression_2 = Expression(x=division, z=number_slider_3, y=scaling, Expression="10 * y * sin(2 * pi * x + z) % 10")
expression_3 = Expression(x=division, z=series_2, y=number_slider_2, Expression="(10 * y/(y+10) * (x ^ 2) * cos(2 * pi * x - z) + y * x) % 10")
expression_4 = Expression(x=division, z=number_slider_3, y=scaling, Expression="y * tan(2 * pi * x - z)% 10")
panel_2 = Panel(division)
pt = ConstructPoint(XCoordinate=expression_2, YCoordinate=expression_3, ZCoordinate=expression_4)
panel_3 = Panel(pt)
series_3 = Series(Start=Slider(1, range=1..10), Step=1, Count=Slider(5, range=1..5))
nurbs = NurbsCurve(Vertices=pt, Degree=series_3, Periodic=False)  # -> Curve, Length, Domain
panel_4 = Panel(nurbs.Curve)
expression_5 = Expression(x=expression_2, y=Slider(166, range=1..255), Expression="(1000 * x + y)%255")
expression_6 = Expression(x=expression, y=Slider(183, range=1..255), Expression="(255 * x+y)%255")
expression_7 = Expression(x=expression_3, y=Slider(1, range=1..255), Expression="(255 * x+y)%255")
rgb = ColourRGB(Alpha=Slider(255, range=0..255), Red=expression_6, Green=expression_7, Blue=expression_5)
preview = CustomPreview(Geometry=nurbs.Curve, Material=rgb)
