# Grasshopper definition assignment1-mess4.gh (Grasshopper 1.0.7)

number_of_points = Slider(186, range=1..1000)
panel = Panel("number")
txt = Text()
series = Series(Start=0, Step=1, Count=number_of_points)
panel_2 = Panel(series)
division = Division(A=panel_2, B=number_of_points)

# ----
# scaling, z vary shape of design
# y variable shifts design across y axis
number_slider = Slider(52, range=1..100)
number_slider_2 = Slider(57, range=0..100)
scaling = Slider(30, range=1..100)
# generate points using trigo functions (modulo 10)
series_2 = Series(Start=0, Step=1, Count=10)
expression = Expression(x=division, z=number_slider, y=scaling, Expression="y * tan(2 * pi * x - z)% 10")
expression_2 = Expression(x=division, z=number_slider, y=scaling, Expression="10 * y * sin(2 * pi * x + z) % 10")
expression_3 = Expression(x=division, z=series_2, y=number_slider_2, Expression="(10 * y/(y+10) * (x ^ 2) * cos(2 * pi * x - z) + y * x) % 10")
expression_4 = Expression(x=division, z=series_2, y=number_slider_2, Expression="(10 * y * (x ^ 2) * cos(2 * pi * x - z) + y * x) % 10")

panel_3 = Panel(division)
degree_of_1st_curve = Slider(1, range=1..10)
number_of_curves = Slider(5, range=1..5)

# ----
# draw lines and curves
pt = ConstructPoint(XCoordinate=expression_2, YCoordinate=expression_3, ZCoordinate=expression)
series_3 = Series(Start=degree_of_1st_curve, Step=1, Count=number_of_curves)
nurbs = NurbsCurve(Vertices=pt, Degree=series_3, Periodic=False)  # -> Curve, Length, Domain

panel_4 = Panel(pt)

# ----
# Set color for lines based on coordinate position
# XYX to RBG
number_slider_3 = Slider(165, range=1..255)
expression_5 = Expression(x=expression_2, y=number_slider_3, Expression="(1000 * x + y)%255")
expression_6 = Expression(x=expression_4, y=Slider(1, range=1..255), Expression="(255 * x+y)%255")
expression_7 = Expression(x=expression_3, y=Slider(1, range=1..255), Expression="(255 * x+y)%255")
rgb = ColourRGB(Alpha=Slider(255, range=0..255), Red=expression_6, Green=expression_7, Blue=expression_5)

panel_5 = Panel(nurbs.Curve)
preview = CustomPreview(Geometry=nurbs.Curve, Material=rgb)
