# Grasshopper definition assignment1_autosave.gh (Grasshopper 1.0.7)

number_slider = Slider(1, range=1..100)
series = Series(Start=0, Step=1, Count=number_slider)
panel = Panel(series)
division = Division(A=panel, B=number_slider)
panel_2 = Panel(division)
