# Grasshopper definition durian.gh (Grasshopper 1.0.7)

number_slider = Slider(28, range=1..100)
expression = Expression(x=number_slider, Expression="1/(x-1)")
nx = Slider(12, range=2..32)
ny = Slider(14, range=2..32)
series = Series(Start=0, Step=expression, Count=number_slider)  # -> graft(Series)
series_2 = Series(Start=0, Step=expression, Count=number_slider)
series_3 = Series(Start=0, Step=1, Count=nx)
series_4 = Series(Start=0, Step=1, Count=ny)
pt = ConstructPoint(XCoordinate=series, YCoordinate=series_2, ZCoordinate=0)
msphere = MeshSphere(Base=pt, Radius=Slider(0.016479, range=0..1), UCount=10, VCount=20)
construct_point = ConstructPoint(XCoordinate=series_3, YCoordinate=graft(series_4), ZCoordinate=0)
deconstruct = Deconstruct(Point=construct_point)  # -> XComponent, YComponent, ZComponent
addition = Addition(A=deconstruct.XComponent, B=deconstruct.YComponent)
construct_point_2 = ConstructPoint(XCoordinate=deconstruct.XComponent, YCoordinate=deconstruct.YComponent, ZCoordinate=addition)
surface_from_points = SurfaceFromPoints(Points=flatten(construct_point_2), UCount=ny, Interpolate=False)
