# Grasshopper definition potato.gh (Grasshopper 1.0.7)

number_slider = Slider(1.946, range=1..3)
A = Slider(0.66, range=0..1)
circle = Circle({Plane=Plane(origin=(4.005597221, 1.677193155, 0), x=(0.3337922352, -0.9426466696, 0), y=(0.9426466696, 0.3337922352, 0)), Radius=4.624398282})
domain = Domain(Domain(0, 1))
line = Line()
num = Number(500)
panel = Panel(domain)
addition = Addition(A=[A, number_slider], B=number_slider)  # -> graft(Result)
pt = Point(Point(3.227544679, 2.813275831, 0))
panel_2 = Panel([pt, num])
range = Range(Domain=panel, Steps=Slider(314, range=0..1000))
panel_3 = Panel(addition)
number_slider_2 = Slider(86, range=1..100)
panel_4 = Panel(range)
cir = Circle(Plane=circle, Radius=number_slider)
sin = Sine(Value=range)
boundary = BoundarySurfaces(Edges=cir)
series = Series(Start=0, Step=1, Count=number_slider_2)
number_slider_3 = Slider(1, range=0..1000)
number_slider_4 = Slider(275, range=0..1000)
panel_5 = Panel(sin)
division = Division(A=series, B=number_slider_2)
multiplication = Multiplication(A=division, B="2 * pi")
series_2 = Series(Start=Slider(0, range=0..1000), Step=number_slider_3, Count=number_slider_4)
panel_6 = Panel(multiplication)
scaling = Slider(62, range=1..100)
panel_7 = Panel(series_2)
cos = Cosine(Value=multiplication)
sin_2 = Sine(Value=multiplication)
python = GhPythonScript()  # -> out, a
# ---------- python: Python ----------
__author__ = "user"
__version__ = "2020.09.21"

import rhinoscriptsyntax as rs
import math

for k in range(0, 100):
    rs.AddPoint(k, k, k)
# ---------- end python ----------
division_2 = Division(A=panel_7, B=number_slider_4)
y_offset = Slider(48, range=1..100)
x_offset = Slider(88, range=1..100)
multiplication_2 = Multiplication(A=scaling, B=sin_2)
expression = Expression(Expression="Format(\"{0}, {1}\", x, y)")
multiplication_3 = Multiplication(A=scaling, B=cos)
multiplication_4 = Multiplication(A=division_2, B="pi")
python_2 = GhPythonScript()  # -> out, a
# ---------- python_2: Python ----------
__author__ = "user"
__version__ = "2020.09.21"

import rhinoscriptsyntax as rs
from math import *
import math

points = []
num_points = 100
radius = 100
x_offset = 0
y_offset = 100

for k in range(num_points):
    norm_k = k / num_points
    x = x_offset + radius * sin(2 * math.pi * norm_k)
    y = y_offset + radius * cos(2 * math.pi * norm_k)
    points.append(rs.CreatePoint(x, y, 0))
    
a = points
# ---------- end python_2 ----------
sin_3 = Sine(Value=multiplication_4)
addition_2 = Addition(A=multiplication_3, B=y_offset)
addition_3 = Addition(A=multiplication_2, B=x_offset)
panel_8 = Panel(python_2.a)
panel_9 = Panel(division_2)
panel_10 = Panel(python_2.out)
multiplication_5 = Multiplication(A=sin_3, B=Slider(100, range=0..100))
pt_2 = ConstructPoint(XCoordinate=addition_3, YCoordinate=addition_2, ZCoordinate=Slider(1, range=1..100))
pt_3 = Point(panel_8)
swatch = ColourSwatch(SwatchColor=RGB(255, 255, 255))
expression_2 = Expression(Expression="index / (count - 1)")
pt_4 = ConstructPoint(XCoordinate=panel_7, YCoordinate=multiplication_5, ZCoordinate=number_slider_3)
panel_11 = Panel(pt_2)
