# Grasshopper definition structures.gh (Grasshopper 1.0.7)

series = Series(Start=0, Step=1, Count=10)  # disabled
panel = Panel(series)  # disabled
graft = GraftTree(Tree=series, IncludeEmptyLists=True, IncludeNullItems=True)  # disabled
number_slider = Slider(1, range=1..100)
number_slider_2 = Slider(5, range=1..100)
viewer = ParamViewer(graft)  # disabled
panel_2 = Panel(graft)  # disabled
number_slider_3 = Slider(1, range=1..100)
col = Slider(5, range=1..10)
number_slider_4 = Slider(6, range=1..100)  # disabled
division = Division(A=number_slider_3, B=number_slider_2)
division_2 = Division(A=number_slider_3, B=number_slider_2)
multiplication = Multiplication(A=Slider(4, range=1..10), B=col)
series_2 = Series(Start=number_slider, Step=division, Count=number_slider_2)
series_3 = Series(Start=number_slider, Step=division_2, Count=number_slider_2)  # -> graft(Series)
charseq = CharSequence(Count=number_slider_4, CharPool="ABCDEFGHIJKLMNOPQRSTUVWXYZ", Format="{0}")  # disabled
series_4 = Series(Start=0, Step=1, Count=number_slider_4)  # -> graft(Series); disabled
series_5 = Series(Start=0, Step=1, Count=number_slider_4)  # disabled
series_6 = Series(Start=0, Step=1, Count=multiplication)
panel_3 = Panel(series_3)
pt = ConstructPoint(XCoordinate=series_3, YCoordinate=series_2, ZCoordinate=0)  # disabled
concat = Concatenate(FragmentA=series_5, FragmentB=charseq)  # disabled
mod = Modulus(A=series_6, B=col)
integer_division = IntegerDivision(A=series_6, B=col)
addition = Addition(A=series_4, B=series_5)  # disabled
panel_4 = Panel(series_6)
series_7 = Series(Start=0, Step=1, Count=10)  # -> graft(Series); disabled
series_8 = Series(Start=0, Step=1, Count=10)  # disabled
panel_5 = Panel(concat)  # disabled
panel_6 = Panel(addition)  # disabled
pt_2 = ConstructPoint(XCoordinate=mod, YCoordinate=integer_division, ZCoordinate=0)
subtraction = Subtraction(A=panel_4, B=Slider(1, range=1..10))
pt_3 = ConstructPoint(XCoordinate=series_7, YCoordinate=series_8, ZCoordinate=0)  # disabled
panel_7 = Panel(pt_3)  # disabled
format = Format(Format="{0}->({1},{2})", Culture=127, Data0=subtraction, Data1=subtraction, Data2=subtraction)
tag = TextTag(Location=pt_2, Text=format, Colour=panel_4)
pline = PolyLine(Vertices=pt_3, Closed=False)  # disabled
panel_8 = Panel("""x
y
z""")  # disabled
panel_9 = Panel("""4
5""")  # disabled
flatten = FlattenTree(Tree=pt_3, Path="{0}")  # disabled
flip = FlipMatrix(Data=panel_7)  # disabled
srfgrid = SurfaceFromPoints(Points=pt_2, UCount=Slider(5, range=1..10), Interpolate=False)
partition = PartitionList(List=panel_7, Size=[3, 2])  # disabled
nor = GateNor()
viewer_2 = ParamViewer(flatten)  # disabled
panel_10 = Panel("""1
2
3
4""")  # disabled
panel_11 = Panel("""A
B
C""")  # disabled
flatten_2 = FlattenTree(Tree=panel_7, Path="{0}")  # disabled
graft_2 = GraftTree(Tree=panel_8, IncludeEmptyLists=True, IncludeNullItems=True)  # disabled
viewer_3 = ParamViewer(flip)  # disabled
panel_12 = Panel(graft_2)  # disabled
concat_2 = Concatenate(FragmentA=graft_2, FragmentB=panel_9)  # disabled
pline_2 = PolyLine(Vertices=flatten_2, Closed=False)  # disabled
viewer_4 = ParamViewer(graft_2)  # disabled
panel_13 = Panel(partition)  # disabled
concat_3 = Concatenate(FragmentA=panel_11, FragmentB=panel_10)  # disabled
panel_14 = Panel(concat_2)  # disabled
panel_15 = Panel(panel_12)  # disabled
panel_16 = Panel(concat_3)  # disabled
entwine = Entwine(Branch00=panel_10, Branch01=panel_13, Branch02=panel_11, FlattenInputs=True)  # disabled
merge = Merge(Data1=panel_10, Data2=panel_13)  # disabled
flatten_3 = FlattenTree(Tree=panel_15, Path="{0}")  # disabled
panel_17 = Panel(merge)  # disabled
panel_18 = Panel(entwine)  # disabled
number_slider_5 = Slider(9, range=1..100)  # disabled
series_9 = Series(Start=0, Step=1, Count=number_slider_5)  # -> graft(Series); disabled
series_10 = Series(Start=0, Step=1, Count=number_slider_5)  # disabled
number_slider_6 = Slider(0, range=0..100)  # disabled
pt_4 = ConstructPoint(XCoordinate=series_9, YCoordinate=series_10, ZCoordinate=0)  # disabled
panel_19 = Panel(pt_4)  # disabled
item = ListItem(List=pt_4, Index=number_slider_6, Wrap=True)  # disabled
index = ItemIndex()  # disabled
panel_20 = Panel(item)  # disabled
panel_21 = Panel("0;0;2")  # disabled
branch = TreeBranch(Tree=panel_20, Path=panel_21, MaintainPaths=True)  # disabled
sph = Sphere(Base=panel_20, Radius=1)  # disabled
viewer_5 = ParamViewer(panel_20)  # disabled
panel_22 = Panel(branch)  # disabled
simplify = SimplifyTree(Tree=panel_20, Front=False)  # disabled
simplify_2 = SimplifyTree(Front=False)  # disabled
item_2 = TreeItem(Tree=panel_20, Path=panel_21, Index=item, Wrap=True)  # disabled
viewer_6 = ParamViewer(simplify)  # disabled
panel_23 = Panel(item_2)  # disabled
